# Grasshopper definition 0.KUKAPRCRobotControlBreakdown.gh (Grasshopper 1.0.8)
# plug-ins: Heteroptera, KUKA|prc - parametric robot control

# Robot Programming
number_slider = Slider(50, range=0..75)

# ---- group: Home
home_extruder = AXISMovementKUKAPrc(Axis1=0, Axis2=-90, Axis3=120, Axis4=0, Axis5=-30, Axis6=0, extaxenabled=False)

# ---- group: Wood Dust
remap_numbers = RemapNumbers(Value=number_slider, Source=Domain(0, 75), Target=Domain(0, 1))  # -> Mapped, Clipped
analog_output_kuka_prc = AnalogOutputKUKAPrc(AnalogOutputNumber=1, OutputState=remap_numbers.Mapped)

# ---- group: Clay
remap_numbers_2 = RemapNumbers(Value=number_slider, Source=Domain(0, 75), Target=Domain(0, 1))  # -> Mapped, Clipped
analog_output_kuka_prc_2 = AnalogOutputKUKAPrc(AnalogOutputNumber=2, OutputState=remap_numbers_2.Mapped)

# ---- group: Printing Toolpath
# Toolpathing
curve = Curve(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)
perp_frames = PerpFrames(Curve=curve, Count=20, Align=True)  # -> Frames, Parameters
deconstruct_plane = DeconstructPlane(Plane=perp_frames.Frames)  # -> Origin, XAxis, YAxis, ZAxis
construct_plane = ConstructPlane(Origin=deconstruct_plane.Origin, XAxis=deconstruct_plane.YAxis, YAxis=deconstruct_plane.ZAxis)
fix_plane_rotation = RotatePlane(Plane=construct_plane, Angle=0)
enumerator = Enumerator(Object=fix_plane_rotation)  # -> Numbers, Color

# ---- group: RobotCell
agilus_kr6_10_r1100_2_robot = AgilusKR610R11002Robot(infiniterot=False)
robot_ip_address = Panel("192.168.1.141")

# ----
merge = Merge(Data1=analog_output_kuka_prc, Data2=analog_output_kuka_prc_2)

# ---- group: Tool Selection
tool = ValueList({"RealSense": 0, "Extruder": 1}, selected="Extruder")

# ---- group: Tool
# 0.KUKAPRC Robot Control Breakdown
# Basic KUKA PRC control definition and toolpathing
# Control Panel
dualextruder = Mesh(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)
extruder = CustomToolKUKAPrc(
    CustomToolGeometry=dualextruder,
    isExternal=False,
    toolid=10,
    toolvala=0,
    toolvalb=0,
    toolvalc=0,
    toolvalx=196.24,
    toolvaly=0.45,
    toolvalz=99.02,
    valuesset=True)
stream_filter = StreamFilter(Gate=tool, Stream1=extruder)

# ----
group_ungroup_commands_kuka_prc = GroupUngroupCommandsKUKAPrc(GroupUngroupCommands=merge)
scanning = Button()

# ---- group: Printing Toolpath
ptp_movement_kuka_prc = PTPMovementKUKAPrc(TargetAsPlane=fix_plane_rotation, StatusTurn="110", Speed=50, extaxenabled=False, interpolation="C_PTP")
data = Data(home_extruder)
merge_2 = Merge(
    Data1=flatten(data),
    Data2=flatten(group_ungroup_commands_kuka_prc),
    Data3=flatten(ptp_movement_kuka_prc),
    Data4=flatten(data))

# ---- group: mxA Control
mxa_connection = BooleanToggle(False)
mxa_reset = Button()

# ----
robot = Data(agilus_kr6_10_r1100_2_robot)
tool_2 = Data(extruder)

# ---- group: Home Preview
point = Point(Point(672.5, 0.45, 528))
panel = Panel("Home|Extruder")

# ----
merge_3 = Merge(Data1=point, Data2=panel)
dispatch = Dispatch(List=merge_3, DispatchPattern=[True, False])  # -> ListA, ListB

# ---- group: Home Preview (continued)
preview = Preview(point=dispatch.ListA, text=dispatch.ListB)  # -> point_3, annotation_dot_2

# ---- group: Simulation
show = BooleanToggle(True)
show_2 = BooleanToggle(False)
simulation_slider = Slider(0, range=0..1)
show_simulation = CSharpScript(Show=show, Nickname="KUKA|prc CORE")  # inputs Show: Boolean, Nickname: String
# ---------- show_simulation: C# ----------
using System;
using System.Linq;
using System.Collections.Generic;
using Grasshopper.Kernel;
using Rhino;

public class Script_Instance : GH_ScriptInstance
{
  private void RunScript(bool Show, string Nickname)
  {
    var doc = GrasshopperDocument;
    if (doc == null) return;

    var objs = doc.Objects
      .Where(o => o.NickName == Nickname)
      .ToList();

    foreach (var obj in objs)
    {
      if (obj is IGH_PreviewObject previewObj)
      {
        previewObj.Hidden = !Show;
      }
    }

    RhinoDoc.ActiveDoc.Views.Redraw();
  }
}
# ---------- end show_simulation ----------
show_target_planes = CSharpScript(Show=show_2, Nickname=["Fix Plane Rotation", "Enumerator"])  # inputs Show: Boolean, Nickname: String; same code as show_simulation

# ---- group: KUKA Core
kuka_prc_core = KUKAPrcCORE(
    SimulationSlider=simulation_slider,
    KUKAPrcCommands=merge_2,
    Tool=tool_2,
    Robot=robot,
    PRC_BaseExpose=False,
    PRC_SaveNameExpose=False,
    PRCsettings="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")  # -> RobotGeometry, AnalysisOutput
mxa_setup_kuka_prc = MxASetupKUKAPrc(
    GO=mxa_connection,
    RESET=mxa_reset,
    Robot=robot,
    Tool=tool_2,
    KUKAPrcCommands=merge_2,
    OVSpeed=10,
    mxAsettings="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")
simulation_analysis = SimulationAnalysis(kuka_prc_analysis_data=kuka_prc_core.AnalysisOutput)  # -> text_2, time
mxa_display_kuka_prc = MxADisplayKUKAPrc(KUKAPrcMxALINK=mxa_setup_kuka_prc)  # -> MxAData, MxAPosition, MxAInputs, MxAState

# ---- group: Simulation (continued)
collision_check = Panel(simulation_analysis.text_2)
program_time = Panel(simulation_analysis.time)

# ----
realtime_monitoring = Panel(mxa_display_kuka_prc.MxAData)

# ==== cluster Preview
point = ClusterInput()
text = ClusterInput()
point_2 = Point(point)
text_2 = Text(text)
point_3 = ClusterOutput(point_2)
move = Move(Geometry=point_2, Motion=Vector(0, 0, 20))  # -> Geometry, Transform
annotation_dot = AnnotationDot(Location=move.Geometry, PrimaryText=text_2, TextHeight=14)  # -> AnnotationDot, Location, PrimaryText, TextHeight
annotation_dot_2 = ClusterOutput(annotation_dot.AnnotationDot)

# ==== cluster SimulationAnalysis
kuka_prc_analysis_data = ClusterInput()
analysis_kuka_prc = AnalysisKUKAPrc(KUKAPrcAnalysisData=kuka_prc_analysis_data)  # -> RobotAxisValues, flatten(RobotCollisionCheck), RobotReachabilityCheck, CommandID, flatten(TimeValue), Planes, CommandTags, IOState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
mass_addition = MassAddition(Input=analysis_kuka_prc.RobotCollisionCheck)  # -> Result, PartialResults
list_item = ListItem(List=analysis_kuka_prc.TimeValue, Index=-1, Wrap=True)
minimum = Minimum(A=mass_addition.Result, B="1")
construct_time = ConstructTime(Hour=0, Minute=0, Second=list_item)
stream_filter = StreamFilter(Gate=minimum, Stream0="No Collison", Stream1="Collison")
text = Text(stream_filter)
text_2 = ClusterOutput(text)
time = ClusterOutput(construct_time)
