# Grasshopper definition 1.Scan&Probe.gh (Grasshopper 1.0.8)
# plug-ins: Heteroptera, KUKA|prc - parametric robot control, RADiiCapture

point = Point(Point(730, 0.6100000143, 790.5))
merge = Merge(Data1=point, Data2="Home|Extruder")

# ---- group: RobotCell
agilus_kr6_10_r1100_2_robot = AgilusKR610R11002Robot(infiniterot=False)
robot_ip_address = Panel("192.168.1.141")

# ---- group: Tool Selection
tool = ValueList({"RealSense": 0, "Extruder": 1}, selected="RealSense")

# ---- group: Tool
# 1.Scan & Probe
# Setup the robot workflow for picking between 2 different tools.
# Tool and realsense calibration workflow logic.
# Control Panel
dualextruder = Mesh(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)
realsense = CustomToolKUKAPrc(
    CustomToolGeometry=dualextruder,
    isExternal=False,
    toolid=11,
    toolvala=0,
    toolvalb=90,
    toolvalc=0,
    toolvalx=62,
    toolvaly=16.45,
    toolvalz=162.9,
    valuesset=True)
extruder = CustomToolKUKAPrc(
    CustomToolGeometry=dualextruder,
    isExternal=False,
    toolid=10,
    toolvala=0,
    toolvalb=0,
    toolvalc=0,
    toolvalx=196.24,
    toolvaly=0.45,
    toolvalz=99.02,
    valuesset=True)
stream_filter = StreamFilter(Gate=tool, Stream0=realsense, Stream1=extruder)

# ---- group: Home
home_extruder = AXISMovementKUKAPrc(Axis1=0, Axis2=-90, Axis3=120, Axis4=0, Axis5=-30, Axis6=0, extaxenabled=False)
home_realsense = AXISMovementKUKAPrc(Axis1=0, Axis2=-90, Axis3=90, Axis4=0, Axis5=0, Axis6=0, extaxenabled=False)
stream_filter_2 = StreamFilter(Gate=tool, Stream0=home_realsense, Stream1=home_extruder)

# ----
scanning = Button()

# ---- group: Scanning Toolpath
_1 = Plane(Plane(origin=(825, 0, 750), x=(-1, 0, 0), y=(0, 1, 0)))
linear_movement_kuka_prc = LINearMovementKUKAPrc(TargetAsPlane=_1, Speed=0.4, extaxenabled=False)
merge_2 = Merge(Data1=stream_filter_2, Data2=linear_movement_kuka_prc)

# ---- group: mxA Control
mxa_connection = BooleanToggle(False)
mxa_reset = Button()

# ---- group: Internalize Point Clouds
point_cloud = PointCloud()
point_cloud_2 = PointCloud()
point_cloud_3 = PointCloud()

# ---- group: RealSense Control
number_slider = Slider(200, range=10..5000)
number_slider_2 = Slider(600, range=10..5000)
number_slider_3 = Slider(0.5, range=0.25..1)
number_slider_4 = Slider(20, range=1..50)
number_slider_5 = Slider(0.4, range=0..1)
number_slider_6 = Slider(20, range=1..100)
boolean_toggle = BooleanToggle(True)

# ---- group: Home Preview
# Robot Programming
point_2 = Point(Point(789.3, 8.550000191, 927))

# ----
merge_3 = Merge(Data1=point_2, Data2="Home|RealSense")
stream_filter_3 = StreamFilter(Gate=tool, Stream0=merge_3, Stream1=merge)
dispatch = Dispatch(List=stream_filter_3, DispatchPattern=[True, False])  # -> ListA, ListB

# ---- group: Home Preview (continued)
preview = Preview(point=dispatch.ListA, text=dispatch.ListB)  # -> point_3, annotation_dot_2

# ---- group: Probing Toolpath
data = Data(stream_filter_2)

# ---- group: Simulation
show = BooleanToggle(True)
show_2 = BooleanToggle(True)
simulation_slider = Slider(0.419, range=0..1)
show_simulation = CSharpScript(Show=show, Nickname="KUKA|prc CORE")  # inputs Show: Boolean, Nickname: String
# ---------- show_simulation: C# ----------
using System;
using System.Linq;
using System.Collections.Generic;
using Grasshopper.Kernel;
using Rhino;

public class Script_Instance : GH_ScriptInstance
{
  private void RunScript(bool Show, string Nickname)
  {
    var doc = GrasshopperDocument;
    if (doc == null) return;

    var objs = doc.Objects
      .Where(o => o.NickName == Nickname)
      .ToList();

    foreach (var obj in objs)
    {
      if (obj is IGH_PreviewObject previewObj)
      {
        previewObj.Hidden = !Show;
      }
    }

    RhinoDoc.ActiveDoc.Views.Redraw();
  }
}
# ---------- end show_simulation ----------
show_target_planes = CSharpScript(Show=show_2, Nickname=["Fix Plane Rotation", "Enumerator"])  # inputs Show: Boolean, Nickname: String; same code as show_simulation

# ---- group: Mesh Pointcloud
quad_remesh_settings = QuadRemeshSettings(TargetCount=50000, AdaptiveSize=0, AdaptiveCount=False, HardEdges=False, SeamEdges=0, Symmetry=0, GuideCurves=0)

# ---- group: RealSense Control (continued)
# Scan & Toolpath Generation
deconstruct_plane = DeconstructPlane(Plane=mxa_display_kuka_prc.MxAPosition)  # -> Origin, XAxis, YAxis, ZAxis
construct_plane = ConstructPlane(Origin=deconstruct_plane.Origin, XAxis=deconstruct_plane.YAxis, YAxis=expr("-x", deconstruct_plane.ZAxis))
capturerealsense = CaptureRealSense(
    CameraPlane=construct_plane,
    ClipNear=number_slider,
    ClipFar=number_slider_2,
    SpatialAlpha=number_slider_3,
    SpatialDelta=number_slider_4,
    TemporalAlpha=number_slider_5,
    TemporalDelta=number_slider_6,
    Capture=scanning,
    On=boolean_toggle)  # -> PointCloud, CameraPlane
data_dam = DataDam(DataA=capturerealsense.PointCloud, BufferDelay=10000000, BufferMode=0)

# ----
point_cloud_4 = PointCloud(data_dam)

# ---- group: Mesh Pointcloud (continued)
point_cloud_attributes = PointCloudAttributes(Cloud=point_cloud_4)  # -> Cloud, Locations, Normals, Colours, Hidden, Extra
entwine = Entwine(Branch00=point_cloud_attributes.Locations, Branch01=point_cloud_attributes.Colours, FlattenInputs=True)
data_dam_2 = DataDam(DataDataA=entwine, BufferDelay=10000000, BufferMode=0)
explode_tree = ExplodeTree(Data=data_dam_2)  # -> Branch0, Branch1
delaunay_mesh = DelaunayMesh(Points=explode_tree.Branch0, Plane=PlaneXY(0, 0, 0))
quad_remesh = QuadRemesh(Geometry=delaunay_mesh, Settings=quad_remesh_settings)

# ---- group: Mesh Coloring
data_dam_3 = DataDam(DataDataA=explode_tree.Branch1, BufferDelay=10000000, BufferMode=0)
mesh_spray = MeshSpray(Mesh=quad_remesh, Points=explode_tree.Branch0, Colours=data_dam_3, SprayMode=0)

# ---- group: Probing Toolpath
dot_detection = CSharpScript(Pointcloud=point_cloud_4, Color=ColourSwatch(SwatchColor=RGB(0, 0, 255)), ColorTolerance=0.4, Distance=50)  # -> Centers; inputs Pointcloud: PointCloud, Color: Color, ColorTolerance: Double, Distance: Double
# ---------- dot_detection: C# ----------
using System;
using System.Collections.Generic;
using System.Collections.Concurrent;
using System.Drawing;
using System.Threading.Tasks;
using Rhino;
using Rhino.Geometry;

public class Script_Instance : GH_ScriptInstance
{
  private void RunScript(
		PointCloud Pointcloud,
		Color Color,
		double ColorTolerance,
		double Distance,
		ref object Centers)
  {
    if (Pointcloud == null || Pointcloud.Count == 0)
    {
      Centers = null;
      return;
    }

    if (!Pointcloud.ContainsColors)
    {
      Centers = null;
      return;
    }

    ColorTolerance = Math.Max(0.0, Math.Min(1.0, ColorTolerance));

    double targetH, targetS, targetV;
    ColorToHSV(Color, out targetH, out targetS, out targetV);

    double hueTol = 180.0 * ColorTolerance;
    double satTol = ColorTolerance;
    double valTol = ColorTolerance;

    ConcurrentBag<Point3d> matchedPtsBag = new ConcurrentBag<Point3d>();

    Parallel.For(0, Pointcloud.Count, i =>
    {
      PointCloudItem item = Pointcloud[i];
      Color c = item.Color;

      if (ColorTolerance <= 0.0)
      {
        if (c.ToArgb() == Color.ToArgb())
          matchedPtsBag.Add(item.Location);
      }
      else
      {
        double h, s, v;
        ColorToHSV(c, out h, out s, out v);

        double dh = HueDistance(targetH, h);
        double ds = Math.Abs(targetS - s);
        double dv = Math.Abs(targetV - v);

        if (dh <= hueTol && ds <= satTol && dv <= valTol)
          matchedPtsBag.Add(item.Location);
      }
    });

    List<Point3d> matchedPts = new List<Point3d>(matchedPtsBag);

    if (matchedPts.Count == 0)
    {
      Centers = null;
      return;
    }

    if (matchedPts.Count == 1)
    {
      Centers = new List<Point3d>() { matchedPts[0] };
      return;
    }

    double tol = RhinoDoc.ActiveDoc != null
      ? RhinoDoc.ActiveDoc.ModelAbsoluteTolerance
      : 0.01;

    double clusterRadius;

    if (Distance > 0.0)
    {
      clusterRadius = Distance;
    }
    else
    {
      BoundingBox bb = new BoundingBox(matchedPts);
      double diag = bb.Diagonal.Length;
      double estimatedSpacing = diag / Math.Max(1.0, Math.Sqrt(matchedPts.Count));
      clusterRadius = Math.Max(tol * 2.0, estimatedSpacing * 2.5);
    }

    RTree tree = new RTree();
    for (int i = 0; i < matchedPts.Count; i++)
      tree.Insert(matchedPts[i], i);

    bool[] visited = new bool[matchedPts.Count];
    List<Point3d> centers = new List<Point3d>();

    for (int i = 0; i < matchedPts.Count; i++)
    {
      if (visited[i]) continue;

      List<int> cluster = FloodCluster(i, matchedPts, tree, visited, clusterRadius);

      if (cluster.Count == 0) continue;

      double x = 0.0;
      double y = 0.0;
      double z = 0.0;

      for (int j = 0; j < cluster.Count; j++)
      {
        Point3d p = matchedPts[cluster[j]];
        x += p.X;
        y += p.Y;
        z += p.Z;
      }

      double count = cluster.Count;
      centers.Add(new Point3d(x / count, y / count, z / count));
    }

    Centers = centers;
  }

  private List<int> FloodCluster(int startIndex, List<Point3d> pts, RTree tree, bool[] visited, double radius)
  {
    List<int> cluster = new List<int>();
    Queue<int> queue = new Queue<int>();

    visited[startIndex] = true;
    queue.Enqueue(startIndex);

    double r2 = radius * radius;

    while (queue.Count > 0)
    {
      int current = queue.Dequeue();
      cluster.Add(current);

      List<int> neighbors = new List<int>();
      Sphere s = new Sphere(pts[current], radius);

      tree.Search(s, (sender, e) =>
      {
        int id = e.Id;
        if (id == current) return;

        if (pts[current].DistanceToSquared(pts[id]) <= r2)
          neighbors.Add(id);
      });

      for (int i = 0; i < neighbors.Count; i++)
      {
        int n = neighbors[i];
        if (!visited[n])
        {
          visited[n] = true;
          queue.Enqueue(n);
        }
      }
    }

    return cluster;
  }

  private double HueDistance(double h1, double h2)
  {
    double d = Math.Abs(h1 - h2);
    return Math.Min(d, 360.0 - d);
  }

  private void ColorToHSV(Color color, out double hue, out double saturation, out double value)
  {
    double r = color.R / 255.0;
    double g = color.G / 255.0;
    double b = color.B / 255.0;

    double max = Math.Max(r, Math.Max(g, b));
    double min = Math.Min(r, Math.Min(g, b));
    double delta = max - min;

    hue = 0.0;

    if (delta > 0.0)
    {
      if (max == r)
        hue = 60.0 * (((g - b) / delta) % 6.0);
      else if (max == g)
        hue = 60.0 * (((b - r) / delta) + 2.0);
      else
        hue = 60.0 * (((r - g) / delta) + 4.0);
    }

    if (hue < 0.0)
      hue += 360.0;

    saturation = (max <= 0.0) ? 0.0 : delta / max;
    value = max;
  }
}
# ---------- end dot_detection ----------
mesh_closest_point = MeshClosestPoint(Point=dot_detection, Mesh=quad_remesh)  # -> Point, Index, Parameter
mesh_eval = MeshEval(Mesh=quad_remesh, Parameter=mesh_closest_point.Parameter)  # -> Point, Normal, Colour
plane_normal = PlaneNormal(Origin=mesh_eval.Point, ZAxis=mesh_eval.Normal)

# ---- group: Probing Toolpath / Retractation
amplitude = Amplitude(Vector=mesh_eval.Normal, Amplitude=75)
move = Move(Geometry=plane_normal, Motion=amplitude)  # -> Geometry, Transform

# ---- group: Probing Toolpath / Traget Safety Offset
amplitude_2 = Amplitude(Vector=mesh_eval.Normal, Amplitude=5)

# ---- group: Probing Toolpath (continued)
move_2 = Move(Geometry=plane_normal, Motion=amplitude_2)  # -> Geometry, Transform
weave = Weave(Pattern=[0, 1, 2], Stream0=move.Geometry, Stream1=move_2.Geometry, Stream2=move.Geometry, NullGaps=False)

# ---- group: Constrain Traget Angle
deconstruct_plane_2 = DeconstructPlane(Plane=weave)  # -> Origin, XAxis, YAxis, ZAxis
angle = Angle(VectorA=Vector(0, -1, 0), VectorB=deconstruct_plane_2.YAxis, Plane=weave)  # -> Angle, Reflex
rotate_plane = RotatePlane(Plane=weave, Angle=angle.Reflex)

# ----
fix_plane_rotation = RotatePlane(Plane=rotate_plane, Angle=85)

# ---- group: Probing Toolpath (continued)
linear_movement_kuka_prc_2 = LINearMovementKUKAPrc(TargetAsPlane=fix_plane_rotation, extaxenabled=False)
merge_4 = Merge(Data1=flatten(data), Data2=flatten(linear_movement_kuka_prc_2), Data3=flatten(data))

# ----
stream_filter_4 = StreamFilter(Gate=tool, Stream0=merge_2, Stream1=merge_4)

# ---- group: KUKA Core
kuka_prc_core = KUKAPrcCORE(
    SimulationSlider=simulation_slider,
    KUKAPrcCommands=stream_filter_4,
    Tool=stream_filter,
    Robot=agilus_kr6_10_r1100_2_robot,
    PRC_BaseExpose=False,
    PRC_SaveNameExpose=False,
    PRCsettings="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")  # -> RobotGeometry, AnalysisOutput
mxa_setup_kuka_prc = MxASetupKUKAPrc(
    GO=mxa_connection,
    RESET=mxa_reset,
    Robot=agilus_kr6_10_r1100_2_robot,
    Tool=stream_filter,
    KUKAPrcCommands=stream_filter_4,
    OVSpeed=10,
    mxAsettings="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")
simulation_analysis = SimulationAnalysis(kuka_prc_analysis_data=kuka_prc_core.AnalysisOutput)  # -> text_2, time
mxa_display_kuka_prc = MxADisplayKUKAPrc(KUKAPrcMxALINK=mxa_setup_kuka_prc)  # -> MxAData, MxAPosition, MxAInputs, MxAState

# ---- group: Simulation (continued)
collision_check = Panel(simulation_analysis.text_2)
program_time = Panel(simulation_analysis.time)

# ----
realtime_monitoring = Panel(mxa_display_kuka_prc.MxAData)

# ---- group: Probing Toolpath (continued)
enumerator = Enumerator(Object=fix_plane_rotation)  # -> Numbers, Color

# ==== cluster Preview
point = ClusterInput()
text = ClusterInput()
point_2 = Point(point)
text_2 = Text(text)
point_3 = ClusterOutput(point_2)
move = Move(Geometry=point_2, Motion=Vector(0, 0, 20))  # -> Geometry, Transform
annotation_dot = AnnotationDot(Location=move.Geometry, PrimaryText=text_2, TextHeight=14)  # -> AnnotationDot, Location, PrimaryText, TextHeight
annotation_dot_2 = ClusterOutput(annotation_dot.AnnotationDot)

# ==== cluster SimulationAnalysis
kuka_prc_analysis_data = ClusterInput()
analysis_kuka_prc = AnalysisKUKAPrc(KUKAPrcAnalysisData=kuka_prc_analysis_data)  # -> RobotAxisValues, flatten(RobotCollisionCheck), RobotReachabilityCheck, CommandID, flatten(TimeValue), Planes, CommandTags, IOState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
mass_addition = MassAddition(Input=analysis_kuka_prc.RobotCollisionCheck)  # -> Result, PartialResults
mass_addition_2 = MassAddition(Input=analysis_kuka_prc.TimeValue)  # -> Result, PartialResults
minimum = Minimum(A=mass_addition.Result, B="1")
construct_time = ConstructTime(Hour=0, Minute=0, Second=mass_addition_2.Result)
stream_filter = StreamFilter(Gate=minimum, Stream0="No Collison", Stream1="Collison")
text = Text(stream_filter)
text_2 = ClusterOutput(text)
time = ClusterOutput(construct_time)
