# Grasshopper definition 2.ConformalPrintingGrowth.gh (Grasshopper 1.0.8)
# plug-ins: Heteroptera, Pufferfish, KUKA|prc - parametric robot control, RADiiCapture

number_slider = Slider(50, range=0..75)

# ---- group: Wood Dust
remap_numbers = RemapNumbers(Value=number_slider, Source=Domain(0, 75), Target=Domain(0, 1))  # -> Mapped, Clipped
analog_output_kuka_prc = AnalogOutputKUKAPrc(AnalogOutputNumber=1, OutputState=remap_numbers.Mapped)

# ---- group: Clay
remap_numbers_2 = RemapNumbers(Value=number_slider, Source=Domain(0, 75), Target=Domain(0, 1))  # -> Mapped, Clipped
analog_output_kuka_prc_2 = AnalogOutputKUKAPrc(AnalogOutputNumber=2, OutputState=remap_numbers_2.Mapped)

# ---- group: RobotCell
agilus_kr6_10_r1100_2_robot = AgilusKR610R11002Robot(infiniterot=False)
robot_ip_address = Panel("192.168.1.141")

# ----
merge = Merge(Data1=analog_output_kuka_prc, Data2=analog_output_kuka_prc_2)

# ---- group: Tool Selection
tool = ValueList({"RealSense": 0, "Extruder": 1}, selected="Extruder")

# ---- group: Tool
# 2.Conformal Printing Growth
# Building on previous script, we are going to generate differential growth
# curves on the scanned mesh and print them.
# Control Panel
dualextruder = Mesh(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)
realsense = CustomToolKUKAPrc(
    CustomToolGeometry=dualextruder,
    isExternal=False,
    toolid=11,
    toolvala=0,
    toolvalb=90,
    toolvalc=0,
    toolvalx=62,
    toolvaly=16.45,
    toolvalz=162.9,
    valuesset=True)
extruder = CustomToolKUKAPrc(
    CustomToolGeometry=dualextruder,
    isExternal=False,
    toolid=10,
    toolvala=0,
    toolvalb=0,
    toolvalc=0,
    toolvalx=196.24,
    toolvaly=0.45,
    toolvalz=99.02,
    valuesset=True)
stream_filter = StreamFilter(Gate=tool, Stream0=realsense, Stream1=extruder)

# ---- group: Home
home_realsense = AXISMovementKUKAPrc(Axis1=0, Axis2=-90, Axis3=90, Axis4=0, Axis5=0, Axis6=0, extaxenabled=False)
home_extruder = AXISMovementKUKAPrc(Axis1=0, Axis2=-90, Axis3=120, Axis4=0, Axis5=-30, Axis6=0, extaxenabled=False)
stream_filter_2 = StreamFilter(Gate=tool, Stream0=home_realsense, Stream1=home_extruder)

# ----
group_ungroup_commands_kuka_prc = GroupUngroupCommandsKUKAPrc(GroupUngroupCommands=merge)
scanning = Button()

# ---- group: Scanning Toolpath
_1 = Plane(Plane(origin=(825, 0, 750), x=(-1, 0, 0), y=(0, 1, 0)))
linear_movement_kuka_prc = LINearMovementKUKAPrc(TargetAsPlane=_1, Speed=0.4, extaxenabled=False)
merge_2 = Merge(Data1=stream_filter_2, Data2=linear_movement_kuka_prc)

# ---- group: mxA Control
mxa_connection = BooleanToggle(False)
mxa_reset = Button()

# ---- group: Internalize Point Clouds
point_cloud = PointCloud()
point_cloud_2 = PointCloud()
point_cloud_3 = PointCloud()

# ---- group: Simulation Start & Reset
reset = Button()
trigger = Trigger(Interval=20, TimerInterval=20, Target=reader)  # disabled

# ---- group: RealSense Control
number_slider_2 = Slider(200, range=10..5000)
number_slider_3 = Slider(600, range=10..5000)
number_slider_4 = Slider(0.5, range=0.25..1)
number_slider_5 = Slider(20, range=1..50)
number_slider_6 = Slider(0.4, range=0..1)
number_slider_7 = Slider(20, range=1..100)
boolean_toggle = BooleanToggle(True)

# ---- group: Home Preview
# Robot Programming
point = Point(Point(789.3, 8.550000191, 927))
point_2 = Point(Point(672.5, 0.45, 528))
merge_3 = Merge(Data1=point_2, Data2="Home|Extruder")

# ----
merge_4 = Merge(Data1=point, Data2="Home|RealSense")
stream_filter_3 = StreamFilter(Gate=tool, Stream0=merge_4, Stream1=merge_3)
dispatch = Dispatch(List=stream_filter_3, DispatchPattern=[True, False])  # -> ListA, ListB

# ---- group: Home Preview (continued)
preview = Preview(point=dispatch.ListA, text=dispatch.ListB)  # -> point_3, annotation_dot_2

# ---- group: Stream GH Mesh to Rhino for Sketching
# 1. Run the "Create Layers" Script
# Click on Stream Mesh
# 
# 
# 2. Use "Sketch" command -> Closed = Yes; OnMesh
# 
# Sketch limit curves first in "Limit" layer.
# Sketch start curves then in "Start" Layer
# 
# 
# 3. Start the differential growth simulation.
# 
# Trigger must be "Playing" and then Reset to start from 0.
# 
# 4. Get curves for toolpathing and preview the geometry
boolean_toggle_2 = BooleanToggle(False)
python_3_script = Python3Script(Run=boolean_toggle_2)  # inputs Run: Boolean
# ---------- python_3_script: Python ----------
import Rhino
import System.Drawing as sd

def reset_layers():
    doc = Rhino.RhinoDoc.ActiveDoc
    if doc is None:
        return

    # Delete all objects
    all_objects = doc.Objects.GetObjectList(Rhino.DocObjects.ObjectType.AnyObject)
    ids = [obj.Id for obj in all_objects]
    for obj_id in ids:
        doc.Objects.Delete(obj_id, True)

    # Create or update Limit
    limit_index = doc.Layers.FindByFullPath("Limit", -1)
    if limit_index < 0:
        limit_layer = Rhino.DocObjects.Layer()
        limit_layer.Name = "Limit"
        limit_layer.Color = sd.Color.Black
        limit_layer.IsVisible = True
        limit_index = doc.Layers.Add(limit_layer)
    else:
        layer = doc.Layers[limit_index]
        layer.Color = sd.Color.Black
        layer.IsVisible = True
        doc.Layers.Modify(layer, limit_index, True)

    # Create or update Start
    start_index = doc.Layers.FindByFullPath("Start", -1)
    if start_index < 0:
        start_layer = Rhino.DocObjects.Layer()
        start_layer.Name = "Start"
        start_layer.Color = sd.Color.Black
        start_layer.IsVisible = True
        start_index = doc.Layers.Add(start_layer)
    else:
        layer = doc.Layers[start_index]
        layer.Color = sd.Color.Black
        layer.IsVisible = True
        doc.Layers.Modify(layer, start_index, True)

    # Set Limit as current layer
    doc.Layers.SetCurrentLayerIndex(limit_index, True)

    # Delete all other layers
    for i in range(doc.Layers.Count - 1, -1, -1):
        layer = doc.Layers[i]
        if layer and not layer.IsDeleted and not layer.IsReference:
            if layer.Name not in ["Limit", "Start"]:
                try:
                    doc.Layers.Delete(i, True)
                except:
                    pass

    doc.Views.Redraw()

if Run:
    reset_layers()
# ---------- end python_3_script ----------

# ---- group: Limit Curve (Closed)
geometry_pipeline = GeometryPipeline(
    GroupByLayer=False,
    GroupByType=False,
    IncludeHidden=True,
    IncludeLocked=True,
    LayerFilter="Limit",
    NameFilter="*",
    SublayerFiltering=True,
    TypeFilter=4)
curve = Curve(geometry_pipeline)
closed = Closed(Curve=curve)  # -> Closed, Periodic
panel = Panel(closed.Closed)

# ---- group: Starting Curves (Closed)
geometry_pipeline_2 = GeometryPipeline(
    GroupByLayer=False,
    GroupByType=False,
    IncludeHidden=True,
    IncludeLocked=True,
    LayerFilter="Start",
    NameFilter="*",
    SublayerFiltering=True,
    TypeFilter=4)
curve_2 = Curve(geometry_pipeline_2)
closed_2 = Closed(Curve=curve_2)  # -> Closed, Periodic
panel_2 = Panel(closed_2.Closed)

# ---- group: Printing Toolpath
data = Data(stream_filter_2)

# ---- group: Simulation
show = BooleanToggle(True)
show_2 = BooleanToggle(False)
simulation_slider = Slider(0.11165, range=0..1)
show_simulation = CSharpScript(Show=show, Nickname="KUKA|prc CORE")  # inputs Show: Boolean, Nickname: String
# ---------- show_simulation: C# ----------
using System;
using System.Linq;
using System.Collections.Generic;
using Grasshopper.Kernel;
using Rhino;

public class Script_Instance : GH_ScriptInstance
{
  private void RunScript(bool Show, string Nickname)
  {
    var doc = GrasshopperDocument;
    if (doc == null) return;

    var objs = doc.Objects
      .Where(o => o.NickName == Nickname)
      .ToList();

    foreach (var obj in objs)
    {
      if (obj is IGH_PreviewObject previewObj)
      {
        previewObj.Hidden = !Show;
      }
    }

    RhinoDoc.ActiveDoc.Views.Redraw();
  }
}
# ---------- end show_simulation ----------
show_target_planes = CSharpScript(Show=show_2, Nickname=["Fix Plane Rotation", "Enumerator"])  # inputs Show: Boolean, Nickname: String; same code as show_simulation

# ---- group: Growth Step Incrementation Loop
reader = Python3Script()  # -> status, data
# ---------- reader: Python ----------
# Outputs:
#   data
#   status

import os

buffer_path = os.path.join(os.getenv('TEMP'), "gh_buffer.txt")

if os.path.exists(buffer_path):
    try:
        with open(buffer_path, "r") as f:
            data = f.read()
        status = "Data read successfully"
    except Exception as e:
        data = None
        status = "Read error: {}".format(e)
else:
    data = None
    status = "Buffer file not found"
# ---------- end reader ----------

# ----
remap_numbers_3 = RemapNumbers(Value=reader.data, Source=Domain(0, 100), Target=Domain(0, 6))  # -> Mapped, Clipped

# ---- group: Mesh Pointcloud
quad_remesh_settings = QuadRemeshSettings(TargetCount=50000, AdaptiveSize=0, AdaptiveCount=False, HardEdges=False, SeamEdges=0, Symmetry=0, GuideCurves=0)

# ---- group: Toolpath & Geometry based on reduced growth steps
layer_thickness_mm = Slider(2, range=0..5)
total_height_mm = Slider(50, range=10..100)
panel_3 = Panel("""0.6
0.7
0.8
0.9
1""")
division = Division(A=total_height_mm, B=layer_thickness_mm)
range = Range(Domain=Domain(0, 1), Steps=division)
multiplication = Multiplication(A=range, B=total_height_mm)
unit_z = UnitZ(Factor=multiplication)

# ---- group: Base Mesh From Capture
# Differential Growth Toolpathing
mesh = Mesh(mesh_4)

# ---- group: Stream GH Mesh to Rhino for Sketching (continued)
content_cache = ContentCache(Name="mesh", Content=mesh, Action=Button())  # -> Name, Content, Result

# ---- group: Limit Curve (Closed) (continued)
c_script = CSharpScript(Curve=curve, Mesh=mesh)  # -> PulledCurve; inputs Curve: list of Curve, Mesh: Mesh
# ---------- c_script: C# ----------
using System;
using System.Collections.Generic;
using System.Threading.Tasks;
using Rhino;
using Rhino.Geometry;

public class Script_Instance : GH_ScriptInstance
{
  private void RunScript(List<Curve> Curve, Mesh Mesh, ref object PulledCurve)
  {
    if (Curve == null || Mesh == null || Curve.Count == 0)
    {
      PulledCurve = null;
      return;
    }

    double tol = RhinoDoc.ActiveDoc != null
      ? RhinoDoc.ActiveDoc.ModelAbsoluteTolerance
      : 0.01;

    Curve[] results = new Curve[Curve.Count];

    Parallel.For(0, Curve.Count, i =>
    {
      Curve crv = Curve[i];

      if (crv == null)
      {
        results[i] = null;
        return;
      }

      try
      {
        Curve pulled = crv.PullToMesh(Mesh, tol);
        results[i] = pulled;
      }
      catch
      {
        results[i] = null;
      }
    });

    PulledCurve = results;
  }
}
# ---------- end c_script ----------
curve_mesh_trim = Python3Script(Mesh=mesh, Polyline=c_script)  # -> out, MeshOut; inputs Mesh: Mesh, Polyline: Polyline
# ---------- curve_mesh_trim: Python ----------
import Rhino.Geometry as rg
from collections import deque
import scriptcontext as sc

# ------------------------------------------------------------
# Helpers
# ------------------------------------------------------------

def get_polyline_points(obj):
    if obj is None:
        return None

    if isinstance(obj, rg.Polyline):
        if obj.IsClosed and len(obj) >= 4:
            return list(obj)
        return None

    if isinstance(obj, rg.PolylineCurve):
        ok, pl = obj.TryGetPolyline()
        if ok and pl.IsClosed and len(pl) >= 4:
            return list(pl)
        return None

    if isinstance(obj, rg.Curve):
        ok, pl = obj.TryGetPolyline()
        if ok and pl.IsClosed and len(pl) >= 4:
            return list(pl)
        return None

    return None


def polyline_center(pts):
    if len(pts) > 1 and pts[0].DistanceTo(pts[-1]) < 1e-9:
        pts = pts[:-1]

    n = len(pts)
    if n == 0:
        return None

    sx = sy = sz = 0.0
    for p in pts:
        sx += p.X
        sy += p.Y
        sz += p.Z

    return rg.Point3d(sx / n, sy / n, sz / n)


def mesh_cache_key(mesh):
    return (mesh.Vertices.Count, mesh.Faces.Count)


def build_face_adjacency(mesh):
    adj = [[] for _ in range(mesh.Faces.Count)]
    topo_edges = mesh.TopologyEdges

    for ei in range(topo_edges.Count):
        connected = topo_edges.GetConnectedFaces(ei)
        if connected and len(connected) == 2:
            a = connected[0]
            b = connected[1]
            adj[a].append(b)
            adj[b].append(a)

    return adj


def get_cached_adjacency(mesh):
    key = ("mesh_adj", mesh_cache_key(mesh))
    if key in sc.sticky:
        return sc.sticky[key]

    adj = build_face_adjacency(mesh)
    sc.sticky[key] = adj
    return adj


def boundary_faces_from_polyline_vertices(mesh, pts):
    boundary = set()

    # uses only existing polyline vertices for speed
    for p in pts[:-1]:
        mp = mesh.ClosestMeshPoint(p, 0.0)
        if mp:
            fi = mp.FaceIndex
            if fi >= 0:
                boundary.add(fi)

    return boundary


def flood_fill_inside(adjacency, boundary_faces, start_face):
    if start_face < 0 or start_face in boundary_faces:
        return set()

    visited = set([start_face])
    q = deque([start_face])

    while q:
        f = q.popleft()
        for nb in adjacency[f]:
            if nb in visited or nb in boundary_faces:
                continue
            visited.add(nb)
            q.append(nb)

    return visited


def keep_relevant_boundary_faces(boundary_faces, inside_faces, adjacency):
    keep_boundary = set()

    for f in boundary_faces:
        inside_n = 0
        outside_n = 0

        for nb in adjacency[f]:
            if nb in inside_faces:
                inside_n += 1
            elif nb not in boundary_faces:
                outside_n += 1

        # keep only if boundary face is biased toward the inside
        if inside_n > outside_n:
            keep_boundary.add(f)

    return keep_boundary


def extract_faces(mesh, keep_faces):
    new_mesh = rg.Mesh()
    vmap = {}

    for fi in keep_faces:
        f = mesh.Faces[fi]

        ids = [f.A, f.B, f.C] if f.IsTriangle else [f.A, f.B, f.C, f.D]
        new_ids = []

        for old_vi in ids:
            if old_vi not in vmap:
                v = mesh.Vertices[old_vi]
                vmap[old_vi] = new_mesh.Vertices.Add(v.X, v.Y, v.Z)
            new_ids.append(vmap[old_vi])

        if f.IsTriangle:
            new_mesh.Faces.AddFace(new_ids[0], new_ids[1], new_ids[2])
        else:
            new_mesh.Faces.AddFace(new_ids[0], new_ids[1], new_ids[2], new_ids[3])

    new_mesh.Vertices.CullUnused()
    new_mesh.Normals.ComputeNormals()
    new_mesh.Compact()
    return new_mesh


# ------------------------------------------------------------
# Main
# ------------------------------------------------------------

MeshOut = None

if Mesh and Polyline:
    pts = get_polyline_points(Polyline)

    if pts:
        center_pt = polyline_center(pts)
        adjacency = get_cached_adjacency(Mesh)
        boundary_faces = boundary_faces_from_polyline_vertices(Mesh, pts)

        mp = Mesh.ClosestMeshPoint(center_pt, 0.0)
        if mp:
            start_face = mp.FaceIndex
            inside_faces = flood_fill_inside(adjacency, boundary_faces, start_face)

            if inside_faces:
                kept_boundary_faces = keep_relevant_boundary_faces(boundary_faces, inside_faces, adjacency)
                final_faces = inside_faces.union(kept_boundary_faces)
                MeshOut = extract_faces(Mesh, final_faces)
# ---------- end curve_mesh_trim ----------
mesh_join = MeshJoin(Meshes=curve_mesh_trim.MeshOut)
mesh_2 = Mesh(mesh_join)

# ----
c_script_2 = CSharpScript(Curve=curve_2, Mesh=mesh)  # -> PulledCurve; inputs Curve: list of Curve, Mesh: Mesh; same code as c_script

# ---- group: Starting Curves (Closed) (continued)
curve_3 = Curve(c_script_2)

# ----
mesh_3 = Mesh(mesh_2)
curve_4 = Curve(curve_3)
divide_curve = DivideCurve(Curve=curve_4, Count=700, Kinks=False)  # -> Points, Tangents, Parameters
polyline = PolyLine(Vertices=divide_curve.Points, Closed=True)
explode = Explode(Curve=polyline, Recursive=True)  # -> Segments, Vertices

# ---- group: Kangaroo Setup
length_line = LengthLine(Line=explode.Segments, Strength=2)
onmesh = OnMesh(Points=divide_curve.Points, Mesh=mesh_3, Strength=50)
spherecollide = SphereCollide(Points=flatten(divide_curve.Points), Radius=remap_numbers_3.Mapped, Strength=1)
merge_5 = Merge(Data1=spherecollide, Data2=onmesh, Data3=length_line)
bouncysolver = BouncySolver(GoalObjects=merge_5, Reset=reset, Threshold=0.0001, Tolerance=0.001, Damping=0.95, Iterations=10, On=False)  # -> I, V, O

# ----
isconverged = CSharpScript(x=bouncysolver.I)  # -> out, A
# ---------- isconverged: C# ----------
using System;
using System.Collections;
using System.Collections.Generic;

using Rhino;
using Rhino.Geometry;

using Grasshopper;
using Grasshopper.Kernel;
using Grasshopper.Kernel.Data;
using Grasshopper.Kernel.Types;

/// <summary>
/// This class will be instantiated on demand by the Script component.
/// </summary>
public class Script_Instance : GH_ScriptInstance
{
  /// <summary>Print a String to the [Out] Parameter of the Script component.</summary>
  /// <param name="text">String to print.</param>
  private void Print(string text) { /* Implementation hidden. */ }
  /// <summary>Print a formatted String to the [Out] Parameter of the Script component.</summary>
  /// <param name="format">String format.</param>
  /// <param name="args">Formatting parameters.</param>
  private void Print(string format, params object[] args) { /* Implementation hidden. */ }
  /// <summary>Print useful information about an object instance to the [Out] Parameter of the Script component. </summary>
  /// <param name="obj">Object instance to parse.</param>
  private void Reflect(object obj) { /* Implementation hidden. */ }
  /// <summary>Print the signatures of all the overloads of a specific method to the [Out] Parameter of the Script component. </summary>
  /// <param name="obj">Object instance to parse.</param>
  private void Reflect(object obj, string method_name) { /* Implementation hidden. */ }

  /// <summary>Gets the current Rhino document.</summary>
  private readonly RhinoDoc RhinoDocument;
  /// <summary>Gets the Grasshopper document that owns this script.</summary>
  private readonly GH_Document GrasshopperDocument;
  /// <summary>Gets the Grasshopper script component that owns this script.</summary>
  private readonly IGH_Component Component;
  /// <summary>
  /// Gets the current iteration count. The first call to RunScript() is associated with Iteration==0.
  /// Any subsequent call within the same solution will increment the Iteration count.
  /// </summary>
  private readonly int Iteration;

  /// <summary>
  /// This procedure contains the user code. Input parameters are provided as regular arguments,
  /// Output parameters as ref arguments. You don't have to assign output parameters,
  /// they will have a default value.
  /// </summary>
  private void RunScript(object x, ref object A)
  {

    Grasshopper.Kernel.IGH_Param param = this.Component.Params.Input[0].Sources[0];
    IGH_Component a = param.Attributes.GetTopLevel.DocObject as IGH_Component;
    A = (a.Message == "Converged");

  }

  // <Custom additional code> 

  // </Custom additional code> 
}
# ---------- end isconverged ----------
unflatten_tree = UnflattenTree(Tree=bouncysolver.V, Guide=divide_curve.Points)

# ---- group: Recording Iteration Number
integer = Integer(isconverged.A)
data_recorder = Python3Script(Data=integer, Reset=reset, Record=True)  # -> DataOut; inputs Data: tree, Reset: Boolean, Record: Boolean
# ---------- data_recorder: Python ----------
# Inputs:
# Data (No Type Hint)  ← IMPORTANT (keep tree structure)
# Record (Boolean)
# Reset (Boolean)

# Output:
# DataOut (Tree)

import Grasshopper as gh

# Initialize
if "recorded_data" not in globals() or Reset:
    recorded_data = gh.DataTree[object]()

# Record
if Record and Data is not None:
    for path in Data.Paths:
        for item in Data.Branch(path):
            recorded_data.Add(item, path)

# Output
DataOut = recorded_data
# ---------- end data_recorder ----------
mass_addition = MassAddition(Input=data_recorder)  # -> Result, PartialResults
x_minus_one = XMinusOne(NumberX=mass_addition.Result)

# ----
clean_tree = CleanTree(RemoveNulls=True, RemoveInvalid=True, RemoveEmpty=True, Tree=unflatten_tree)
polyline_2 = PolyLine(Vertices=clean_tree, Closed=True)

# ---- group: Recording Curve Iteration
stream_gate = StreamGate(Stream=polyline_2, Gate=isconverged.A)  # -> Target0, Target1
data_recorder_2 = Python3Script(Data=stream_gate.Target1, Reset=reset, Record=True)  # -> DataOut; inputs Data: tree, Reset: Boolean, Record: Boolean; same code as data_recorder
rebuild_curve = RebuildCurve(Curve=data_recorder_2, Degree=3, Count=500, Tangents=False)

# ---- group: Growth Step Incrementation Loop (continued)
writer = Python3Script(data=x_minus_one)  # -> status
# ---------- writer: Python ----------
# Inputs:
#   data: string or number to store
# Outputs:
#   status: feedback message for panel

import os

if data is not None:
    buffer_path = os.path.join(os.getenv('TEMP'), "gh_buffer.txt")
    try:
        with open(buffer_path, "w") as f:
            f.write(str(data))
        status = "Data written to: {}".format(buffer_path)
    except Exception as e:
        status = "Write error: {}".format(e)
else:
    status = "No input data received"
# ---------- end writer ----------

# ---- group: Preview Toolpath Geometry
stream_gate_2 = StreamGate(Stream=rebuild_curve, Gate=Toggle(False))  # -> Target0, Target1

# ---- group: Toolpath & Geometry based on reduced growth steps (continued)
curve_5 = Curve(stream_gate_2.Target1)
list_length = ListLength(List=curve_5)
multiplication_2 = Multiplication(A=list_length, B=panel_3)
list_item = ListItem(List=curve_5, Index=expr("x-1", multiplication_2), Wrap=True)  # -> simplify(Item)
tween_through_curves = TweenThroughCurves(
    Curves=list_item,
    Factor=range,
    Normalized=True,
    Equalized=False,
    Loopback=False,
    InterpolationType=1,
    Refit=0,
    PointSample=0)
move = Move(Geometry=reverse(tween_through_curves), Motion=unit_z)  # -> Geometry, Transform
loft = Loft(Curves=move.Geometry, Options={Adjust=False, Closed=False, LoftEnds=0, LoftSimp=0, LoftType=0, Rebuild=10, Refit=0.01})
custom_preview = CustomPreview(
    Geometry=loft,
    Material={diffuse=RGB(221, 160, 221), emission=RGB(66, 48, 66), shine=0.5, specular=RGB(255, 255, 255), transparency=0})

# ---- group: All Curve Growth Iteration
curve_6 = Curve(move.Geometry)

# ---- group: Last Curve Growth Iteration
curve_7 = Curve(polyline_2)

# ---- group: Printing Toolpath
data_dam = DataDam(DataDataA=curve_7, BufferDelay=10000000, BufferMode=0)
divide_curve_2 = DivideCurve(Curve=data_dam, Count=2000, Kinks=False)  # -> flatten(Points), Tangents, Parameters

# ---- group: RealSense Control (continued)
# Scan & Meshing
deconstruct_plane = DeconstructPlane(Plane=mxa_display_kuka_prc.MxAPosition)  # -> Origin, XAxis, YAxis, ZAxis
construct_plane = ConstructPlane(Origin=deconstruct_plane.Origin, XAxis=deconstruct_plane.YAxis, YAxis=expr("-x", deconstruct_plane.ZAxis))
capturerealsense = CaptureRealSense(
    CameraPlane=construct_plane,
    ClipNear=number_slider_2,
    ClipFar=number_slider_3,
    SpatialAlpha=number_slider_4,
    SpatialDelta=number_slider_5,
    TemporalAlpha=number_slider_6,
    TemporalDelta=number_slider_7,
    Capture=scanning,
    On=boolean_toggle)  # -> PointCloud, CameraPlane
data_dam_2 = DataDam(DataA=capturerealsense.PointCloud, BufferDelay=10000000, BufferMode=0)

# ----
point_cloud_4 = PointCloud(data_dam_2)

# ---- group: Mesh Pointcloud (continued)
point_cloud_attributes = PointCloudAttributes(Cloud=point_cloud_4)  # -> Cloud, Locations, Normals, Colours, Hidden, Extra
entwine = Entwine(Branch00=point_cloud_attributes.Locations, Branch01=point_cloud_attributes.Colours, FlattenInputs=True)
data_dam_3 = DataDam(DataDataA=entwine, BufferDelay=10000000, BufferMode=0)
explode_tree = ExplodeTree(Data=data_dam_3)  # -> Branch0, Branch1
delaunay_mesh = DelaunayMesh(Points=explode_tree.Branch0, Plane=PlaneXY(0, 0, 0))
quad_remesh = QuadRemesh(Geometry=delaunay_mesh, Settings=quad_remesh_settings)

# ---- group: Base Mesh From Capture
mesh_4 = Mesh(quad_remesh)

# ---- group: Mesh Coloring
data_dam_4 = DataDam(DataDataA=explode_tree.Branch1, BufferDelay=10000000, BufferMode=0)
mesh_spray = MeshSpray(Mesh=quad_remesh, Points=explode_tree.Branch0, Colours=data_dam_4, SprayMode=0)

# ---- group: Printing Toolpath / Base Mesh From Capture
mesh_5 = Mesh(mesh_4)

# ---- group: Printing Toolpath (continued)
mesh_closest_point = MeshClosestPoint(Point=divide_curve_2.Points, Mesh=mesh_5)  # -> Point, Index, Parameter
mesh_eval = MeshEval(Mesh=mesh_5, Parameter=mesh_closest_point.Parameter)  # -> Point, Normal, Colour
plane_normal = PlaneNormal(Origin=mesh_eval.Point, ZAxis=mesh_eval.Normal)
plane_origin = PlaneOrigin(Base=plane_normal, Origin=divide_curve_2.Points)

# ---- group: Printing Toolpath / Traget Safety Offset
amplitude = Amplitude(Vector=mesh_eval.Normal, Amplitude=10)

# ---- group: Printing Toolpath (continued)
move_2 = Move(Geometry=plane_origin, Motion=amplitude)  # -> Geometry, Transform

# ---- group: Constrain Target Angle
deconstruct_plane_2 = DeconstructPlane(Plane=move_2.Geometry)  # -> Origin, XAxis, YAxis, ZAxis
angle = Angle(VectorA=Vector(0, -1, 0), VectorB=deconstruct_plane_2.YAxis, Plane=move_2.Geometry)  # -> Angle, Reflex
rotate_plane = RotatePlane(Plane=move_2.Geometry, Angle=angle.Reflex)

# ----
fix_plane_rotation = RotatePlane(Plane=rotate_plane, Angle=85)

# ---- group: Printing Toolpath (continued)
ptp_movement_kuka_prc = PTPMovementKUKAPrc(TargetAsPlane=fix_plane_rotation, StatusTurn="110", Speed=50, extaxenabled=False, interpolation="C_PTP")
merge_6 = Merge(
    Data1=flatten(data),
    Data2=flatten(group_ungroup_commands_kuka_prc),
    Data3=flatten(ptp_movement_kuka_prc),
    Data4=flatten(data))

# ----
stream_filter_4 = StreamFilter(Gate=tool, Stream0=merge_2, Stream1=merge_6)

# ---- group: KUKA Core
kuka_prc_core = KUKAPrcCORE(
    SimulationSlider=simulation_slider,
    KUKAPrcCommands=stream_filter_4,
    Tool=stream_filter,
    Robot=agilus_kr6_10_r1100_2_robot,
    PRC_BaseExpose=False,
    PRC_SaveNameExpose=False,
    PRCsettings="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")  # -> RobotGeometry, AnalysisOutput
mxa_setup_kuka_prc = MxASetupKUKAPrc(
    GO=mxa_connection,
    RESET=mxa_reset,
    Robot=agilus_kr6_10_r1100_2_robot,
    Tool=stream_filter,
    KUKAPrcCommands=stream_filter_4,
    OVSpeed=10,
    mxAsettings="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")
simulation_analysis = SimulationAnalysis(kuka_prc_analysis_data=kuka_prc_core.AnalysisOutput)  # -> text_2, time
mxa_display_kuka_prc = MxADisplayKUKAPrc(KUKAPrcMxALINK=mxa_setup_kuka_prc)  # -> MxAData, MxAPosition, MxAInputs, MxAState

# ---- group: Simulation (continued)
collision_check = Panel(simulation_analysis.text_2)
program_time = Panel(simulation_analysis.time)

# ----
realtime_monitoring = Panel(mxa_display_kuka_prc.MxAData)

# ---- group: Printing Toolpath (continued)
enumerator = Enumerator(Object=fix_plane_rotation)  # -> Numbers, Color

# ==== cluster Preview
point = ClusterInput()
text = ClusterInput()
point_2 = Point(point)
text_2 = Text(text)
point_3 = ClusterOutput(point_2)
move = Move(Geometry=point_2, Motion=Vector(0, 0, 20))  # -> Geometry, Transform
annotation_dot = AnnotationDot(Location=move.Geometry, PrimaryText=text_2, TextHeight=14)  # -> AnnotationDot, Location, PrimaryText, TextHeight
annotation_dot_2 = ClusterOutput(annotation_dot.AnnotationDot)

# ==== cluster SimulationAnalysis
kuka_prc_analysis_data = ClusterInput()
analysis_kuka_prc = AnalysisKUKAPrc(KUKAPrcAnalysisData=kuka_prc_analysis_data)  # -> RobotAxisValues, flatten(RobotCollisionCheck), RobotReachabilityCheck, CommandID, flatten(TimeValue), Planes, CommandTags, IOState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
mass_addition = MassAddition(Input=analysis_kuka_prc.RobotCollisionCheck)  # -> Result, PartialResults
list_item = ListItem(List=analysis_kuka_prc.TimeValue, Index=-1, Wrap=True)
minimum = Minimum(A=mass_addition.Result, B="1")
construct_time = ConstructTime(Hour=0, Minute=0, Second=list_item)
stream_filter = StreamFilter(Gate=minimum, Stream0="No Collison", Stream1="Collison")
text = Text(stream_filter)
text_2 = ClusterOutput(text)
time = ClusterOutput(construct_time)
