# Grasshopper definition 1.GHScan2Houdini.gh (Grasshopper 1.0.8)
# plug-ins: Heteroptera, KUKA|prc - parametric robot control, RADiiCapture

# Houdini Bridge
panel = Panel("G:\My Drive\1.Lab\2.Education\2.Workshops\2026.CAADRIA\")
export = BooleanToggle(False)

# ---- group: RobotCell
agilus_kr6_10_r1100_2_robot = AgilusKR610R11002Robot(infiniterot=False)
robot_ip_address = Panel("192.168.1.141")

# ----
mesh_example = Mesh(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)
c_script = CSharpScript(mesh=mesh_example, Path=panel, Export=export)  # -> Log; inputs mesh: Mesh, Path: String, Export: Boolean
# ---------- c_script: C# ----------
using System;
using System.IO;

using Rhino;
using Rhino.Geometry;
using Rhino.FileIO;

using Grasshopper;
using Grasshopper.Kernel;

public class Script_Instance : GH_ScriptInstance
{
  private static string lastMessage = "No export yet";
  private static int versionCounter = 0;

  private void RunScript(Mesh mesh, string Path, bool Export, ref object Log)
  {
    Log = lastMessage;

    if (!Export) return;

    if (mesh == null)
    {
      lastMessage = "Mesh is null";
      Log = lastMessage;
      return;
    }

    if (string.IsNullOrEmpty(Path) || !Directory.Exists(Path))
    {
      lastMessage = "Invalid directory";
      Log = lastMessage;
      return;
    }

    try
    {
      // duplicate + clean mesh
      Mesh m = mesh.DuplicateMesh();

      if (!m.IsValid)
        m.RebuildNormals();

      m.Faces.ConvertQuadsToTriangles();
      m.Normals.ComputeNormals();
      m.UnifyNormals();
      m.Compact();

      if (!m.IsValid || m.Faces.Count == 0)
      {
        lastMessage = "Invalid mesh";
        Log = lastMessage;
        return;
      }

      var doc = RhinoDoc.ActiveDoc;

      // versioning
      versionCounter++;
      string fileName = $"mesh_{versionCounter.ToString("000")}.fbx";
      string fullPath = System.IO.Path.Combine(Path, fileName);

      // bake mesh
      Guid id = doc.Objects.AddMesh(m);

      doc.Objects.UnselectAll();
      doc.Objects.Select(id);

      // FBX export command (Rhino pipeline)
      string cmd = "_-Export \"" + fullPath + "\" _Enter";
      RhinoApp.RunScript(cmd, false);

      // cleanup
      doc.Objects.Delete(id, true);

      if (File.Exists(fullPath))
        lastMessage = "Exported: " + fileName;
      else
        lastMessage = "Export failed";
    }
    catch (Exception e)
    {
      lastMessage = "Error: " + e.Message;
    }

    Log = lastMessage;
  }
}
# ---------- end c_script ----------

# ---- group: Tool Selection
tool = ValueList({"RealSense": 0, "Extruder": 1}, selected="Extruder")

# ---- group: Tool
# 2.Conformal Printing Growth
# Building on previous script, we are going to generate differential growth
# curves on the scanned mesh and print them.
# Control Panel
dualextruder = Mesh(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)
realsense = CustomToolKUKAPrc(
    CustomToolGeometry=dualextruder,
    isExternal=False,
    toolid=11,
    toolvala=0,
    toolvalb=90,
    toolvalc=0,
    toolvalx=62,
    toolvaly=16.45,
    toolvalz=162.9,
    valuesset=True)
extruder = CustomToolKUKAPrc(
    CustomToolGeometry=dualextruder,
    isExternal=False,
    toolid=10,
    toolvala=0,
    toolvalb=0,
    toolvalc=0,
    toolvalx=196.24,
    toolvaly=0.45,
    toolvalz=99.02,
    valuesset=True)
stream_filter = StreamFilter(Gate=tool, Stream0=realsense, Stream1=extruder)

# ---- group: Home
home_extruder = AXISMovementKUKAPrc(Axis1=0, Axis2=-90, Axis3=120, Axis4=0, Axis5=-30, Axis6=0, extaxenabled=False)
home_realsense = AXISMovementKUKAPrc(Axis1=0, Axis2=-90, Axis3=90, Axis4=0, Axis5=0, Axis6=0, extaxenabled=False)
stream_filter_2 = StreamFilter(Gate=tool, Stream0=home_realsense, Stream1=home_extruder)

# ----
panel_2 = Panel(c_script)
scanning = Button()

# ---- group: Scanning Toolpath
_1 = Plane(Plane(origin=(825, 0, 750), x=(-1, 0, 0), y=(0, 1, 0)))
linear_movement_kuka_prc = LINearMovementKUKAPrc(TargetAsPlane=_1, Speed=0.4, extaxenabled=False)
merge = Merge(Data1=stream_filter_2, Data2=linear_movement_kuka_prc)

# ----
import = BooleanToggle(True)
examplemesh = Mesh(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)

# ---- group: mxA Control
mxa_connection = BooleanToggle(False)
mxa_reset = Button()

# ----
c_script_2 = CSharpScript(Path="C:\Users\celso\Desktop\csv_example.csv", Import=import)  # -> out, Curves, Layer_num, Mix, PointsTree; inputs Path: String, Import: Boolean
# ---------- c_script_2: C# ----------
using System;
using System.IO;
using System.Collections.Generic;

using Rhino.Geometry;

using Grasshopper;
using Grasshopper.Kernel;
using Grasshopper.Kernel.Data;
using Grasshopper.Kernel.Types;

public class Script_Instance : GH_ScriptInstance
{
  // Persistent cache
  private string lastPath = null;
  private DateTime lastWriteTime = DateTime.MinValue;

  private List<Curve> cache_curves = new List<Curve>();
  private List<int> cache_layers = new List<int>();
  private GH_Structure<GH_Number> cache_mix = new GH_Structure<GH_Number>();
  private GH_Structure<GH_Point> cache_pts = new GH_Structure<GH_Point>();

  private void RunScript(
		string Path,
		bool Import,
		ref object Curves,
		ref object Layer_num,
		ref object Mix,
		ref object PointsTree)
  {
    // Always output cached data
    Curves = cache_curves;
    Layer_num = cache_layers;
    Mix = cache_mix;
    PointsTree = cache_pts;

    // No trigger → do nothing
    if (!Import) return;

    if (string.IsNullOrEmpty(Path) || !File.Exists(Path)) return;

    DateTime writeTime = File.GetLastWriteTime(Path);

    // Only reload if file changed
    if (Path == lastPath && writeTime == lastWriteTime)
      return;

    lastPath = Path;
    lastWriteTime = writeTime;

    // Clear cache
    cache_curves = new List<Curve>();
    cache_layers = new List<int>();
    cache_mix = new GH_Structure<GH_Number>();
    cache_pts = new GH_Structure<GH_Point>();

    using (var reader = new StreamReader(Path))
    {
      string headerLine = reader.ReadLine();
      if (headerLine == null) return;

      char sep = headerLine.Contains(";") ? ';' : ',';
      var headers = headerLine.Split(sep);

      int idx_curve = Array.IndexOf(headers, "curve_id");
      int idx_layer = Array.IndexOf(headers, "layer");
      int idx_x = Array.IndexOf(headers, "x");
      int idx_y = Array.IndexOf(headers, "y");
      int idx_z = Array.IndexOf(headers, "z");
      int idx_mix = Array.IndexOf(headers, "mix");

      if (idx_curve < 0 || idx_layer < 0 || idx_x < 0 ||
          idx_y < 0 || idx_z < 0 || idx_mix < 0)
        return;

      int current_id = -1;
      int current_layer = 0;

      var pts = new List<Point3d>();
      var mx = new List<double>();

      int curve_index = 0;

      while (!reader.EndOfStream)
      {
        var line = reader.ReadLine();
        if (string.IsNullOrWhiteSpace(line)) continue;

        var cols = line.Split(sep);

        int cid = Convert.ToInt32(cols[idx_curve]);

        if (cid != current_id)
        {
          if (pts.Count > 0)
          {
            var path = new GH_Path(curve_index);

            cache_curves.Add(new PolylineCurve(pts));
            cache_layers.Add(current_layer);

            for (int i = 0; i < mx.Count; i++)
              cache_mix.Append(new GH_Number(mx[i]), path);

            for (int i = 0; i < pts.Count; i++)
              cache_pts.Append(new GH_Point(pts[i]), path);

            curve_index++;
          }

          pts = new List<Point3d>();
          mx = new List<double>();

          current_id = cid;
          current_layer = Convert.ToInt32(cols[idx_layer]);
        }

        double x = Convert.ToDouble(cols[idx_x]);
        double y = Convert.ToDouble(cols[idx_y]);
        double z = Convert.ToDouble(cols[idx_z]);

        // same transform as Python
        pts.Add(new Point3d(x, -z, y));
        mx.Add(Convert.ToDouble(cols[idx_mix]));
      }

      // last curve
      if (pts.Count > 0)
      {
        var path = new GH_Path(curve_index);

        cache_curves.Add(new PolylineCurve(pts));
        cache_layers.Add(current_layer);

        for (int i = 0; i < mx.Count; i++)
          cache_mix.Append(new GH_Number(mx[i]), path);

        for (int i = 0; i < pts.Count; i++)
          cache_pts.Append(new GH_Point(pts[i]), path);
      }
    }
  }
}
# ---------- end c_script_2 ----------
number = Number(c_script_2.Mix)
number_2 = Number(number)

# ---- group: Variable Analog Commands
number_3 = Number(flatten(number_2))
subtraction = Subtraction(A="1", B=number_3)
wood_dust = AnalogOutputKUKAPrc(AnalogOutputNumber=1, OutputState=number_3)
clay = AnalogOutputKUKAPrc(AnalogOutputNumber=2, OutputState=subtraction)
weave = Weave(Pattern=[0, 1], Stream0=graft(wood_dust), Stream1=graft(clay), NullGaps=False)

# ----
point = Point(c_script_2.PointsTree)
# Variable Extrusion Toolpathing
point_2 = Point(point)

# ---- group: Preview
gradient = Gradient(
    LowerLimit=0,
    UpperLimit=1,
    Parameter=number_2,
    stops=[0: RGB(234, 38, 0), 0.25: RGB(234, 126, 0), 0.5: RGB(254, 244, 84), 0.75: RGB(173, 203, 249), 1: RGB(75, 107, 169)])
text_tag = TextTag(Location=point_2, Text=number_2)
cloud_display = CloudDisplay(Points=point_2, Colours=gradient, Size=1.5, SpriteType=0)

# ---- group: Internalize Point Clouds
point_cloud = PointCloud()
point_cloud_2 = PointCloud()
point_cloud_3 = PointCloud()

# ---- group: RealSense Control
number_slider = Slider(200, range=10..5000)
number_slider_2 = Slider(600, range=10..5000)
number_slider_3 = Slider(0.5, range=0.25..1)
number_slider_4 = Slider(20, range=1..50)
number_slider_5 = Slider(0.4, range=0..1)
number_slider_6 = Slider(20, range=1..100)
boolean_toggle = BooleanToggle(True)

# ---- group: Home Preview
# Robot Programming
point_3 = Point(Point(789.3, 8.550000191, 927))
point_4 = Point(Point(672.5, 0.45, 528))
merge_2 = Merge(Data1=point_4, Data2="Home|Extruder")

# ----
merge_3 = Merge(Data1=point_3, Data2="Home|RealSense")
stream_filter_3 = StreamFilter(Gate=tool, Stream0=merge_3, Stream1=merge_2)
dispatch = Dispatch(List=stream_filter_3, DispatchPattern=[True, False])  # -> ListA, ListB

# ---- group: Home Preview (continued)
preview = Preview(point=dispatch.ListA, text=dispatch.ListB)  # -> point_3, annotation_dot_2

# ---- group: Printing Toolpath
group_ungroup_commands_kuka_prc = GroupUngroupCommandsKUKAPrc(GroupUngroupCommands=weave)  # -> flatten(GroupedUngroupedCommands)
data = Data(stream_filter_2)

mesh_closest_point = MeshClosestPoint(Point=point_2, Mesh=examplemesh)  # -> Point, Index, Parameter
mesh_eval = MeshEval(Mesh=examplemesh, Parameter=mesh_closest_point.Parameter)  # -> Point, Normal, Colour
plane_normal = PlaneNormal(Origin=mesh_eval.Point, ZAxis=mesh_eval.Normal)

# ---- group: Printing Toolpath / Traget Safety Offset
amplitude = Amplitude(Vector=mesh_eval.Normal, Amplitude=10)

# ----
plane_origin = PlaneOrigin(Base=plane_normal, Origin=point_2)

# ---- group: Simulation
show = BooleanToggle(True)
show_2 = BooleanToggle(False)
simulation_slider = Slider(1, range=0..1)
show_simulation = CSharpScript(Show=show, Nickname="KUKA|prc CORE")  # inputs Show: Boolean, Nickname: String
# ---------- show_simulation: C# ----------
using System;
using System.Linq;
using System.Collections.Generic;
using Grasshopper.Kernel;
using Rhino;

public class Script_Instance : GH_ScriptInstance
{
  private void RunScript(bool Show, string Nickname)
  {
    var doc = GrasshopperDocument;
    if (doc == null) return;

    var objs = doc.Objects
      .Where(o => o.NickName == Nickname)
      .ToList();

    foreach (var obj in objs)
    {
      if (obj is IGH_PreviewObject previewObj)
      {
        previewObj.Hidden = !Show;
      }
    }

    RhinoDoc.ActiveDoc.Views.Redraw();
  }
}
# ---------- end show_simulation ----------
show_target_planes = CSharpScript(Show=show_2, Nickname=["Fix Plane Rotation", "Enumerator"])  # inputs Show: Boolean, Nickname: String; same code as show_simulation

# ---- group: Printing Toolpath (continued)
move = Move(Geometry=plane_origin, Motion=amplitude)  # -> Geometry, Transform

# ---- group: Constrain Target Angle
deconstruct_plane = DeconstructPlane(Plane=move.Geometry)  # -> Origin, XAxis, YAxis, ZAxis
angle = Angle(VectorA=Vector(0, -1, 0), VectorB=deconstruct_plane.YAxis, Plane=move.Geometry)  # -> Angle, Reflex
xy_plane = XYPlane(Origin=Point(0, 0, 0))
rotate_plane = RotatePlane(Plane=move.Geometry, Angle=angle.Reflex)
c_script_3 = CSharpScript(Planes=rotate_plane, TargetPlane=xy_plane, Strength=1)  # -> out, PlanesOut; inputs Planes: tree of Plane, TargetPlane: Plane, Strength: Double
# ---------- c_script_3: C# ----------
using System;
using System.Collections.Generic;

using Rhino.Geometry;

using Grasshopper;
using Grasshopper.Kernel.Data;
using Grasshopper.Kernel.Types;

public class Script_Instance : GH_ScriptInstance
{
  private void RunScript(
		DataTree<Plane> Planes,
		Plane TargetPlane,
		double Strength,
		ref object PlanesOut)
  {
    // Strength controls how strongly later branches follow target (0-1)
    // 0 = original, 1 = fully target-aligned

    var output = new DataTree<Plane>();

    int branchCount = Planes.BranchCount;

    for (int b = 0; b < branchCount; b++)
    {
      var branch = Planes.Branch(b);
      var path = Planes.Path(b);

      for (int i = 0; i < branch.Count; i++)
      {
        Plane p = branch[i];

        double t = branchCount <= 1 ? 1.0 : (double)b / (branchCount - 1);

        // progressive bias toward target (non-linear feel optional)
        double w = Strength * t;

        // 1. interpolate normal ONLY
        Vector3d n0 = p.ZAxis;
        Vector3d n1 = TargetPlane.ZAxis;

        n0.Unitize();
        n1.Unitize();

        Vector3d n = n0 * (1.0 - w) + n1 * w;
        n.Unitize();

        // 2. preserve original X axis as much as possible
        Vector3d x = p.XAxis;
        x = x - Vector3d.Multiply(Vector3d.Multiply(x, n), n); // project onto plane
        x.Unitize();

        // 3. rebuild orthogonal basis
        Vector3d y = Vector3d.CrossProduct(n, x);
        y.Unitize();

        Plane newPlane = new Plane(p.Origin, x, y);

        output.Add(newPlane, path);
      }
    }

    PlanesOut = output;
  }
}
# ---------- end c_script_3 ----------

# ----
fix_plane_rotation = RotatePlane(Plane=c_script_3.PlanesOut, Angle=degrees(170))  # -> flatten(Plane)

# ---- group: Printing Toolpath (continued)
ptp_movement_kuka_prc = PTPMovementKUKAPrc(TargetAsPlane=fix_plane_rotation, StatusTurn="110", Speed=50, extaxenabled=False, interpolation="C_PTP")
weave_2 = Weave(Pattern=[0, 1], Stream0=ptp_movement_kuka_prc, Stream1=group_ungroup_commands_kuka_prc, NullGaps=False)
merge_4 = Merge(Data1=flatten(data), Data2=flatten(weave_2), Data3=flatten(data))

# ----
panel_3 = Panel(weave_2)
stream_filter_4 = StreamFilter(Gate=tool, Stream0=merge, Stream1=merge_4)

# ---- group: KUKA Core
kuka_prc_core = KUKAPrcCORE(
    SimulationSlider=simulation_slider,
    KUKAPrcCommands=stream_filter_4,
    Tool=stream_filter,
    Robot=agilus_kr6_10_r1100_2_robot,
    PRC_BaseExpose=False,
    PRC_SaveNameExpose=False,
    PRCsettings="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")  # -> RobotGeometry, AnalysisOutput
mxa_setup_kuka_prc = MxASetupKUKAPrc(
    GO=mxa_connection,
    RESET=mxa_reset,
    Robot=agilus_kr6_10_r1100_2_robot,
    Tool=stream_filter,
    KUKAPrcCommands=stream_filter_4,
    OVSpeed=10,
    mxAsettings="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")
simulation_analysis = SimulationAnalysis(kuka_prc_analysis_data=kuka_prc_core.AnalysisOutput)  # -> text_2, time
mxa_display_kuka_prc = MxADisplayKUKAPrc(KUKAPrcMxALINK=mxa_setup_kuka_prc)  # -> MxAData, MxAPosition, MxAInputs, MxAState

# ---- group: RealSense Control (continued)
# Scan & Meshing
deconstruct_plane_2 = DeconstructPlane(Plane=mxa_display_kuka_prc.MxAPosition)  # -> Origin, XAxis, YAxis, ZAxis
construct_plane = ConstructPlane(Origin=deconstruct_plane_2.Origin, XAxis=deconstruct_plane_2.YAxis, YAxis=expr("-x", deconstruct_plane_2.ZAxis))
capturerealsense = CaptureRealSense(
    CameraPlane=construct_plane,
    ClipNear=number_slider,
    ClipFar=number_slider_2,
    SpatialAlpha=number_slider_3,
    SpatialDelta=number_slider_4,
    TemporalAlpha=number_slider_5,
    TemporalDelta=number_slider_6,
    Capture=scanning,
    On=boolean_toggle)  # -> PointCloud, CameraPlane
data_dam = DataDam(DataA=capturerealsense.PointCloud, BufferDelay=10000000, BufferMode=0)

# ----
point_cloud_4 = PointCloud(data_dam)

# ---- group: Simulation (continued)
collision_check = Panel(simulation_analysis.text_2)
program_time = Panel(simulation_analysis.time)

# ---- group: Mesh Pointcloud
point_cloud_attributes = PointCloudAttributes(Cloud=point_cloud_4)  # -> Cloud, Locations, Normals, Colours, Hidden, Extra
entwine = Entwine(Branch00=point_cloud_attributes.Locations, Branch01=point_cloud_attributes.Colours, FlattenInputs=True)
data_dam_2 = DataDam(DataDataA=entwine, BufferDelay=10000000, BufferMode=0)
explode_tree = ExplodeTree(Data=data_dam_2)  # -> Branch0, Branch1
quad_remesh_settings = QuadRemeshSettings(TargetCount=50000, AdaptiveSize=0, AdaptiveCount=False, HardEdges=False, SeamEdges=0, Symmetry=0, GuideCurves=0)
delaunay_mesh = DelaunayMesh(Points=explode_tree.Branch0, Plane=PlaneXY(0, 0, 0))
quad_remesh = QuadRemesh(Geometry=delaunay_mesh, Settings=quad_remesh_settings)

# ----
realtime_monitoring = Panel(mxa_display_kuka_prc.MxAData)

# ---- group: Mesh Coloring
data_dam_3 = DataDam(DataDataA=explode_tree.Branch1, BufferDelay=10000000, BufferMode=0)
mesh_spray = MeshSpray(Mesh=quad_remesh, Points=explode_tree.Branch0, Colours=data_dam_3, SprayMode=0)

# ---- group: Printing Toolpath (continued)
enumerator = Enumerator(Object=fix_plane_rotation)  # -> Numbers, Color

# ---- group: Base Mesh From Capture
mesh = Mesh(mesh_spray)

mesh_2 = Mesh(mesh)

# ---- group: Printing Toolpath / Base Mesh From Capture
mesh_3 = Mesh(mesh)

# ==== cluster Preview
point = ClusterInput()
text = ClusterInput()
point_2 = Point(point)
text_2 = Text(text)
point_3 = ClusterOutput(point_2)
move = Move(Geometry=point_2, Motion=Vector(0, 0, 20))  # -> Geometry, Transform
annotation_dot = AnnotationDot(Location=move.Geometry, PrimaryText=text_2, TextHeight=14)  # -> AnnotationDot, Location, PrimaryText, TextHeight
annotation_dot_2 = ClusterOutput(annotation_dot.AnnotationDot)

# ==== cluster SimulationAnalysis
kuka_prc_analysis_data = ClusterInput()
analysis_kuka_prc = AnalysisKUKAPrc(KUKAPrcAnalysisData=kuka_prc_analysis_data)  # -> RobotAxisValues, flatten(RobotCollisionCheck), RobotReachabilityCheck, CommandID, flatten(TimeValue), Planes, CommandTags, IOState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
mass_addition = MassAddition(Input=analysis_kuka_prc.RobotCollisionCheck)  # -> Result, PartialResults
list_item = ListItem(List=analysis_kuka_prc.TimeValue, Index=-1, Wrap=True)
minimum = Minimum(A=mass_addition.Result, B="1")
construct_time = ConstructTime(Hour=0, Minute=0, Second=list_item)
stream_filter = StreamFilter(Gate=minimum, Stream0="No Collison", Stream1="Collison")
text = Text(stream_filter)
text_2 = ClusterOutput(text)
time = ClusterOutput(construct_time)
