# Grasshopper definition Houdini2Rhino.gh (Grasshopper 1.0.8)

panel = Panel("C:\Users\HanxW\OneDrive - University College London\00_Package of works\28_CAADRIA Workshop 2026\Day 3\curves_export4.csv")
py3 = Python3Script(filepath=panel)  # -> out, curves, layer_num, pscale; inputs filepath: String
# ---------- py3: Python ----------
import csv
import Rhino.Geometry as rg
from Grasshopper import DataTree
from Grasshopper.Kernel.Data import GH_Path

curves = []
layers = []
pscales = DataTree[float]()
current_id = -1
current_layer = 0
pts = []
ps = []
curve_index = 0

with open(filepath, 'r') as f:
    reader = csv.DictReader(f)
    for row in reader:
        cid = int(row["curve_id"])
        if cid != current_id:
            if pts:
                points = [rg.Point3d(p[0], p[1], p[2]) for p in pts]
                curves.append(rg.PolylineCurve(points))
                layers.append(current_layer)
                path = GH_Path(curve_index)
                for v in ps:
                    pscales.Add(v, path)
                curve_index += 1
            pts = []
            ps = []
            current_id = cid
            current_layer = int(row["layer"])
        pts.append((float(row["x"]), -float(row["z"]), float(row["y"])))
        ps.append(float(row["pscale"]))
    
    # last curve
    if pts:
        points = [rg.Point3d(p[0], p[1], p[2]) for p in pts]
        curves.append(rg.PolylineCurve(points))
        layers.append(current_layer)
        path = GH_Path(curve_index)
        for v in ps:
            pscales.Add(v, path)

a = curves   # list of polyline curves
b = layers   # layer index per curve
c = pscales  # pscale per point, branched by curve
# ---------- end py3 ----------
panel_2 = Panel(py3.pscale)
