# Grasshopper definition stigmergy growth.gh (Grasshopper 1.0.8)
# plug-ins: Pufferfish, DendroGH

# ---- group: Base Mesh From Capture
# 1. Run the "Create Layers" Script
# Click on Stream Mesh
# 
# 
# 2. Use "Sketch" command -> Closed = Yes; OnMesh
# 
# Sketch limit curves first in "Limit" layer.
# Sketch start curves then in "Start" Layer
# 
# 
# 3. Start the differential growth simulation.
# 
# Trigger must be "Playing" and then Reset to start from 0.
# 
# 4. Get curves for toolpathing and preview the geometry
mesh = Mesh(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)

# ----
c_script = CSharpScript(
    VoxelDensity=50,
    FoodIntensity=1,
    FoodPropagation=0.1,
    Speed=0.3,
    SensorDistance=6,
    SensorAngle=30,
    RotationAngle=12.5,
    Deposit=0.05,
    Decay=0.12,
    Diffuse=0.1,
    Randomness=0.1,
    MinMoveForDeposit=0.1,
    CrowdRadius=3,
    CrowdPenalty=0.9,
    StuckSteps=6,
    TrailLength=300,
    EdgeAvoidance=2,
    Reset=False)  # -> out, Voxels, VoxelValues, AgentsOut, Trail; inputs BoundingBox: Box, VoxelDensity: Double, MeshConstraint: Mesh, Food: list of Point3d, FoodIntensity: Double, FoodPropagation: Double, Agents: list of Point3d, Speed: Double, SensorDistance: Double, SensorAngle: Double, RotationAngle: Double, Deposit: Double, Decay: Double, Diffuse: Double, Randomness: Double, MinMoveForDeposit: Double, CrowdRadius: Double, CrowdPenalty: Double, StuckSteps: Int32, TrailLength: Int32, EdgeAvoidance: Double, Reset: Boolean; disabled
# ---------- c_script: C# ----------
using System;
using System.Collections.Generic;
using Rhino.Geometry;
using Grasshopper.Kernel.Data;
using Grasshopper.Kernel.Types;

// ============================================================
// DEFAULT OUTPUTS
// ============================================================
Voxels = new List<Point3d>();
VoxelValues = new List<double>();
AgentsOut = new List<Point3d>();
Trail = new GH_Structure<GH_Point>();

// ============================================================
// SANITIZE
// ============================================================
if (TrailLength < 1) TrailLength = 1;
if (VoxelDensity < 2) VoxelDensity = 2;
if (EdgeAvoidance < 0.0) EdgeAvoidance = 0.0;
if (MinMoveForDeposit < 0.0) MinMoveForDeposit = 0.0;
if (CrowdRadius < 0.0) CrowdRadius = 0.0;
if (CrowdPenalty < 0.0) CrowdPenalty = 0.0;
if (CrowdPenalty > 1.0) CrowdPenalty = 1.0;
if (StuckSteps < 1) StuckSteps = 1;

if (Food == null) Food = new List<Point3d>();
if (Agents == null) Agents = new List<Point3d>();

// ============================================================
// GLOBAL STORAGE
// ============================================================
if (SolverMemory.Store == null)
	SolverMemory.Store = new Dictionary<string, DualStateSim>();

string solverKey = "main";

string configKey =
	(BoundingBox.IsValid ? BoundingBox.BoundingBox.Min.ToString() + BoundingBox.BoundingBox.Max.ToString() : "invalid")
	+ "|" + VoxelDensity.ToString()
	+ "|" + TrailLength.ToString()
	+ "|" + EdgeAvoidance.ToString()
	+ "|" + MinMoveForDeposit.ToString()
	+ "|" + CrowdRadius.ToString()
	+ "|" + CrowdPenalty.ToString()
	+ "|" + StuckSteps.ToString()
	+ "|" + Food.Count.ToString()
	+ "|" + Agents.Count.ToString()
	+ "|" + ((MeshConstraint != null && MeshConstraint.IsValid) ? MeshConstraint.Vertices.Count.ToString() : "nomesh");

bool needInit = Reset || !SolverMemory.Store.ContainsKey(solverKey);

if (!needInit)
{
	var oldState = SolverMemory.Store[solverKey];
	if (oldState.ConfigKey != configKey)
		needInit = true;
}

if (needInit)
{
	if (!BoundingBox.IsValid) return;

	BoundingBox bb = BoundingBox.BoundingBox;

	double sx = bb.Max.X - bb.Min.X;
	double sy = bb.Max.Y - bb.Min.Y;
	double sz = bb.Max.Z - bb.Min.Z;
	double maxDim = Math.Max(sx, Math.Max(sy, sz));

	if (maxDim <= Rhino.RhinoMath.ZeroTolerance) return;

	double spacing = maxDim / VoxelDensity;
	if (spacing <= Rhino.RhinoMath.ZeroTolerance) return;

	int nx = Math.Max(2, (int)Math.Round(sx / spacing) + 1);
	int ny = Math.Max(2, (int)Math.Round(sy / spacing) + 1);
	int nz = Math.Max(2, (int)Math.Round(sz / spacing) + 1);

	var state = new DualStateSim();
	state.ConfigKey = configKey;
	state.Box = bb;
	state.NX = nx;
	state.NY = ny;
	state.NZ = nz;
	state.Spacing = spacing;
	state.StepCount = 0;

	state.VoxelPts = new List<Point3d>();
	state.TrailField = new double[nx * ny * nz];
	state.FoodField = new double[nx * ny * nz];

	state.AgentPts = new List<Point3d>();
	state.AgentDirs = new List<Vector3d>();
	state.AgentSource = new List<int>();
	state.AgentTarget = new List<int>();
	state.AgentLoaded = new List<bool>();
	state.AgentStuckCount = new List<int>();

	state.Trails = new List<Queue<Point3d>>();
	state.NakedEdges = new List<Curve>();
	state.Random = new Random(Guid.NewGuid().GetHashCode());

	// ------------------------------------------------------------
	// Cache naked mesh edges
	// ------------------------------------------------------------
	if (MeshConstraint != null && MeshConstraint.IsValid)
	{
		Polyline[] naked = MeshConstraint.GetNakedEdges();
		if (naked != null)
		{
			for (int i = 0; i < naked.Length; i++)
			{
				if (naked[i] != null && naked[i].Count >= 2)
					state.NakedEdges.Add(new PolylineCurve(naked[i]));
			}
		}
	}

	// ------------------------------------------------------------
	// Build voxel grid
	// ------------------------------------------------------------
	for (int i = 0; i < nx; i++)
	{
		double tx = (nx == 1) ? 0.0 : (double)i / (nx - 1);
		for (int j = 0; j < ny; j++)
		{
			double ty = (ny == 1) ? 0.0 : (double)j / (ny - 1);
			for (int k = 0; k < nz; k++)
			{
				double tz = (nz == 1) ? 0.0 : (double)k / (nz - 1);
				Point3d p = BoundingBox.PointAt(tx, ty, tz);
				state.VoxelPts.Add(p);
			}
		}
	}

	// ------------------------------------------------------------
	// Static food field with sharp radius falloff
	// ------------------------------------------------------------
	FoodPropagation = Clamp01(FoodPropagation);
	FoodIntensity = Math.Max(0.0, FoodIntensity);

	if (Food.Count > 0 && FoodIntensity > 0.0)
	{
		double radius = Math.Max(spacing * 1.5, spacing + FoodPropagation * maxDim * 0.10);
		double sharpness = 5.0;

		for (int i = 0; i < state.VoxelPts.Count; i++)
		{
			double v = 0.0;
			Point3d vp = state.VoxelPts[i];

			for (int f = 0; f < Food.Count; f++)
			{
				double d = vp.DistanceTo(Food[f]);

				if (d < radius)
				{
					double t = d / radius;
					v += FoodIntensity * Math.Pow(1.0 - t, sharpness);
				}
			}

			state.FoodField[i] = Clamp01(v);
		}
	}

	// ------------------------------------------------------------
	// Initialize agents
	// ------------------------------------------------------------
	for (int a = 0; a < Agents.Count; a++)
	{
		Point3d p = Agents[a];

		if (MeshConstraint != null && MeshConstraint.IsValid)
		{
			MeshPoint mp = MeshConstraint.ClosestMeshPoint(p, 0.0);
			if (mp != null) p = mp.Point;
		}
		else
		{
			p = ClampToBox(p, bb);
		}

		Vector3d dir = RandomUnit(state.Random);

		if (MeshConstraint != null && MeshConstraint.IsValid)
		{
			MeshPoint mpN = MeshConstraint.ClosestMeshPoint(p, 0.0);
			if (mpN != null)
			{
				Vector3d n = MeshConstraint.NormalAt(mpN);
				if (n.IsValid && n.Length > Rhino.RhinoMath.ZeroTolerance)
				{
					n.Unitize();
					dir = ProjectToPlane(dir, n);
					if (dir.Length < Rhino.RhinoMath.ZeroTolerance)
						dir = AnyPerpendicular(n);
					dir.Unitize();
				}
			}
		}

		int source = 0;
		int target = 0;
		bool loaded = false;

		if (Food.Count > 0)
		{
			source = NearestFoodIndex(p, Food);
			target = RandomDifferentIndex(source, Food.Count, state.Random);
		}

		state.AgentPts.Add(p);
		state.AgentDirs.Add(dir);
		state.AgentSource.Add(source);
		state.AgentTarget.Add(target);
		state.AgentLoaded.Add(loaded);
		state.AgentStuckCount.Add(0);

		var q = new Queue<Point3d>();
		q.Enqueue(p);
		state.Trails.Add(q);
	}

	SolverMemory.Store[solverKey] = state;
}

// ============================================================
// STEP
// ============================================================
var s = SolverMemory.Store[solverKey];
s.StepCount++;

Deposit = Math.Max(0.0, Deposit);
Decay = Clamp01(Decay);
Diffuse = Clamp01(Diffuse);
Randomness = Math.Max(0.0, Randomness);

double sensorRad = Rhino.RhinoMath.ToRadians(SensorAngle);
double rotateRad = Rhino.RhinoMath.ToRadians(RotationAngle);

// Behavior constants
double targetWeight = 3.50;
double trailWeight = 0.45;
double loadedDepositFactor = 1.30;
double reachRadius = Math.Max(s.Spacing * 2.0, Speed * 2.0);
double snapRadius = Math.Max(s.Spacing * 1.5, Speed * 1.5);
double dynamicRandomness = Randomness * Math.Exp(-0.002 * s.StepCount);

double[] depositBuffer = new double[s.TrailField.Length];

for (int a = 0; a < s.AgentPts.Count; a++)
{
	Point3d p = s.AgentPts[a];
	Vector3d dir = s.AgentDirs[a];
	int source = s.AgentSource[a];
	int target = s.AgentTarget[a];
	bool loaded = s.AgentLoaded[a];
	int stuckCount = s.AgentStuckCount[a];

	if (dir.Length < Rhino.RhinoMath.ZeroTolerance)
		dir = RandomUnit(s.Random);

	dir.Unitize();

	Vector3d axis = Vector3d.ZAxis;

	if (MeshConstraint != null && MeshConstraint.IsValid)
	{
		MeshPoint mpN = MeshConstraint.ClosestMeshPoint(p, 0.0);
		if (mpN != null)
		{
			Vector3d n = MeshConstraint.NormalAt(mpN);
			if (n.IsValid && n.Length > Rhino.RhinoMath.ZeroTolerance)
			{
				n.Unitize();
				axis = n;
			}
		}
	}

	Vector3d dirL = Rotate(dir, axis, sensorRad);
	Vector3d dirR = Rotate(dir, axis, -sensorRad);

	Point3d pF = p + dir * SensorDistance;
	Point3d pL = p + dirL * SensorDistance;
	Point3d pR = p + dirR * SensorDistance;

	int activeFoodIndex = loaded ? source : target;
	Point3d targetPt = (Food.Count > 0) ? Food[activeFoodIndex] : Point3d.Unset;

	double fF = trailWeight * SampleTrailField(pF, s) + targetWeight * LocalFoodAttraction(pF, targetPt, FoodIntensity, FoodPropagation, s.Spacing, s.Box.Diagonal.Length);
	double fL = trailWeight * SampleTrailField(pL, s) + targetWeight * LocalFoodAttraction(pL, targetPt, FoodIntensity, FoodPropagation, s.Spacing, s.Box.Diagonal.Length);
	double fR = trailWeight * SampleTrailField(pR, s) + targetWeight * LocalFoodAttraction(pR, targetPt, FoodIntensity, FoodPropagation, s.Spacing, s.Box.Diagonal.Length);

	if (fL > fF && fL > fR)
		dir = Rotate(dir, axis, rotateRad);
	else if (fR > fF && fR > fL)
		dir = Rotate(dir, axis, -rotateRad);

	// Direct target steering
	if (targetPt.IsValid)
	{
		Vector3d toTarget = targetPt - p;
		if (MeshConstraint != null && MeshConstraint.IsValid)
			toTarget = ProjectToPlane(toTarget, axis);

		if (toTarget.IsValid && toTarget.Length > Rhino.RhinoMath.ZeroTolerance)
		{
			toTarget.Unitize();
			double targetBlend = loaded ? 0.40 : 0.30;
			dir = dir * (1.0 - targetBlend) + toTarget * targetBlend;
		}
	}

	// ------------------------------------------------------------
	// Edge avoidance
	// ------------------------------------------------------------
	double edgeFactor = 1.0;

	if (MeshConstraint != null && MeshConstraint.IsValid && s.NakedEdges != null && s.NakedEdges.Count > 0 && EdgeAvoidance > Rhino.RhinoMath.ZeroTolerance)
	{
		Point3d closestEdgePt = Point3d.Unset;
		double minDist = double.MaxValue;

		for (int e = 0; e < s.NakedEdges.Count; e++)
		{
			double t;
			if (s.NakedEdges[e].ClosestPoint(p, out t))
			{
				Point3d cp = s.NakedEdges[e].PointAt(t);
				double d = p.DistanceTo(cp);
				if (d < minDist)
				{
					minDist = d;
					closestEdgePt = cp;
				}
			}
		}

		if (closestEdgePt.IsValid && minDist < EdgeAvoidance)
		{
			double t = 1.0 - (minDist / EdgeAvoidance);
			t = Clamp01(t);

			Vector3d away = p - closestEdgePt;
			away = ProjectToPlane(away, axis);

			if (away.IsValid && away.Length > Rhino.RhinoMath.ZeroTolerance)
			{
				away.Unitize();
				double avoidBlend = 0.25 + 0.55 * t;
				dir = dir * (1.0 - avoidBlend) + away * avoidBlend;
				dir.Unitize();
			}

			edgeFactor = 1.0 - 0.9 * t;
		}
	}

	// random turn
	if (dynamicRandomness > 0.0)
	{
		double jitter = (s.Random.NextDouble() * 2.0 - 1.0) * dynamicRandomness * rotateRad;
		dir = Rotate(dir, axis, jitter);
	}

	dir.Unitize();

	Point3d next = p + dir * Speed;

	if (MeshConstraint != null && MeshConstraint.IsValid)
	{
		MeshPoint mp = MeshConstraint.ClosestMeshPoint(next, 0.0);
		if (mp != null)
		{
			next = mp.Point;

			Vector3d n = MeshConstraint.NormalAt(mp);
			if (n.IsValid && n.Length > Rhino.RhinoMath.ZeroTolerance)
			{
				n.Unitize();
				dir = ProjectToPlane(dir, n);
				if (dir.Length < Rhino.RhinoMath.ZeroTolerance)
					dir = AnyPerpendicular(n);
				dir.Unitize();
			}
		}
	}
	else
	{
		next = ClampToBox(next, s.Box);

		if (Math.Abs(next.X - s.Box.Min.X) < 1e-9 || Math.Abs(next.X - s.Box.Max.X) < 1e-9) dir.X *= -1.0;
		if (Math.Abs(next.Y - s.Box.Min.Y) < 1e-9 || Math.Abs(next.Y - s.Box.Max.Y) < 1e-9) dir.Y *= -1.0;
		if (Math.Abs(next.Z - s.Box.Min.Z) < 1e-9 || Math.Abs(next.Z - s.Box.Max.Z) < 1e-9) dir.Z *= -1.0;
		dir.Unitize();
	}

	// snap to target
	if (targetPt.IsValid && next.DistanceTo(targetPt) < snapRadius)
		next = targetPt;

	double moved = p.DistanceTo(next);

	if (moved < MinMoveForDeposit)
		stuckCount++;
	else
		stuckCount = 0;

	// ------------------------------------------------------------
	// Crowd factor
	// ------------------------------------------------------------
	int localCount = 0;
	double crowdFactor = 1.0;

	if (CrowdRadius > Rhino.RhinoMath.ZeroTolerance)
	{
		double crowdR2 = CrowdRadius * CrowdRadius;

		for (int j = 0; j < s.AgentPts.Count; j++)
		{
			if (j == a) continue;
			if (next.DistanceToSquared(s.AgentPts[j]) < crowdR2)
				localCount++;
		}

		if (localCount > 0)
		{
			double crowdSuppression = CrowdPenalty * Math.Min(1.0, localCount / 6.0);
			crowdFactor = 1.0 - crowdSuppression;

			Vector3d awayCrowd = Vector3d.Zero;

			for (int j = 0; j < s.AgentPts.Count; j++)
			{
				if (j == a) continue;

				Vector3d v = next - s.AgentPts[j];
				double d2 = v.SquareLength;

				if (d2 > Rhino.RhinoMath.ZeroTolerance && d2 < crowdR2)
				{
					v.Unitize();
					awayCrowd += v;
				}
			}

			if (awayCrowd.Length > Rhino.RhinoMath.ZeroTolerance)
			{
				if (MeshConstraint != null && MeshConstraint.IsValid)
					awayCrowd = ProjectToPlane(awayCrowd, axis);

				if (awayCrowd.Length > Rhino.RhinoMath.ZeroTolerance)
				{
					awayCrowd.Unitize();
					double crowdBlend = 0.15 * CrowdPenalty;
					dir = dir * (1.0 - crowdBlend) + awayCrowd * crowdBlend;
					dir.Unitize();
				}
			}
		}
	}

	// ------------------------------------------------------------
	// Break stuck agents
	// ------------------------------------------------------------
	if (stuckCount >= StuckSteps)
	{
		Vector3d resetDir = RandomUnit(s.Random);

		if (MeshConstraint != null && MeshConstraint.IsValid)
		{
			resetDir = ProjectToPlane(resetDir, axis);
			if (resetDir.Length < Rhino.RhinoMath.ZeroTolerance)
				resetDir = AnyPerpendicular(axis);
		}

		resetDir.Unitize();
		dir = resetDir;
		stuckCount = 0;
	}

	// reached target?
	if (Food.Count > 0)
	{
		if (next.DistanceTo(targetPt) <= reachRadius)
		{
			if (!loaded)
			{
				loaded = true;
			}
			else
			{
				loaded = false;
				source = activeFoodIndex;
				target = RandomDifferentIndex(source, Food.Count, s.Random);
			}
		}
	}

	int vi = ClosestVoxelIndex(next, s.Box, s.NX, s.NY, s.NZ);
	if (vi >= 0 && vi < depositBuffer.Length)
	{
		double d = Deposit;

		// no reward for stagnation
		if (moved < MinMoveForDeposit)
			d = 0.0;

		if (loaded) d *= loadedDepositFactor;

		d *= (1.0 + 1.2 * s.TrailField[vi] * s.TrailField[vi]);
		d *= edgeFactor;
		d *= crowdFactor;

		depositBuffer[vi] += d;
	}

	s.AgentPts[a] = next;
	s.AgentDirs[a] = dir;
	s.AgentSource[a] = source;
	s.AgentTarget[a] = target;
	s.AgentLoaded[a] = loaded;
	s.AgentStuckCount[a] = stuckCount;

	var q = s.Trails[a];
	q.Enqueue(next);
	while (q.Count > TrailLength)
		q.Dequeue();
}

// ============================================================
// APPLY DEPOSIT
// ============================================================
for (int i = 0; i < s.TrailField.Length; i++)
{
	if (depositBuffer[i] > 0.0)
		s.TrailField[i] = Math.Min(1.0, s.TrailField[i] + depositBuffer[i]);
}

// ============================================================
// DIFFUSE + ADAPTIVE DECAY + PRUNING
// ============================================================
double[] nextTrail = new double[s.TrailField.Length];

for (int x = 0; x < s.NX; x++)
{
	for (int y = 0; y < s.NY; y++)
	{
		for (int z = 0; z < s.NZ; z++)
		{
			int i = ToIndex(x, y, z, s.NY, s.NZ);
			double center = s.TrailField[i];

			double sum = center;
			int count = 1;

			if (x > 0)        { sum += s.TrailField[ToIndex(x - 1, y, z, s.NY, s.NZ)]; count++; }
			if (x < s.NX - 1) { sum += s.TrailField[ToIndex(x + 1, y, z, s.NY, s.NZ)]; count++; }
			if (y > 0)        { sum += s.TrailField[ToIndex(x, y - 1, z, s.NY, s.NZ)]; count++; }
			if (y < s.NY - 1) { sum += s.TrailField[ToIndex(x, y + 1, z, s.NY, s.NZ)]; count++; }
			if (z > 0)        { sum += s.TrailField[ToIndex(x, y, z - 1, s.NY, s.NZ)]; count++; }
			if (z < s.NZ - 1) { sum += s.TrailField[ToIndex(x, y, z + 1, s.NY, s.NZ)]; count++; }

			double avg = sum / count;
			double v = Lerp(center, avg, Diffuse);

			double adaptiveDecay = Decay;
			if (center < 0.08) adaptiveDecay *= 2.5;
			else if (center < 0.15) adaptiveDecay *= 1.5;

			v *= (1.0 - adaptiveDecay);

			double pruneThreshold = 0.03;
			if (v < pruneThreshold) v = 0.0;

			nextTrail[i] = Clamp01(v);
		}
	}
}

s.TrailField = nextTrail;

// ============================================================
// BUILD OUTPUT VALUES
// ============================================================
var valuesOut = new List<double>(s.TrailField.Length);
for (int i = 0; i < s.TrailField.Length; i++)
{
	valuesOut.Add(Clamp01(s.TrailField[i] + 0.75 * s.FoodField[i]));
}

// ============================================================
// REBUILD TRAIL TREE
// ============================================================
var trailTree = new GH_Structure<GH_Point>();
for (int i = 0; i < s.Trails.Count; i++)
{
	var path = new GH_Path(i);
	foreach (Point3d pt in s.Trails[i])
	{
		trailTree.Append(new GH_Point(pt), path);
	}
}

// ============================================================
// OUTPUTS
// ============================================================
Voxels = s.VoxelPts;
VoxelValues = valuesOut;
AgentsOut = s.AgentPts;
Trail = trailTree;


// ============================================================
// HELPERS
// ============================================================

double Clamp01(double v)
{
	if (v < 0.0) return 0.0;
	if (v > 1.0) return 1.0;
	return v;
}

double Lerp(double a, double b, double t)
{
	return a + (b - a) * t;
}

int ToIndex(int x, int y, int z, int ny, int nz)
{
	return x * ny * nz + y * nz + z;
}

int ClosestVoxelIndex(Point3d p, BoundingBox box, int nx, int ny, int nz)
{
	double dx = Math.Max(box.Max.X - box.Min.X, Rhino.RhinoMath.ZeroTolerance);
	double dy = Math.Max(box.Max.Y - box.Min.Y, Rhino.RhinoMath.ZeroTolerance);
	double dz = Math.Max(box.Max.Z - box.Min.Z, Rhino.RhinoMath.ZeroTolerance);

	double tx = (p.X - box.Min.X) / dx;
	double ty = (p.Y - box.Min.Y) / dy;
	double tz = (p.Z - box.Min.Z) / dz;

	tx = Clamp01(tx);
	ty = Clamp01(ty);
	tz = Clamp01(tz);

	int ix = (int)Math.Round(tx * (nx - 1));
	int iy = (int)Math.Round(ty * (ny - 1));
	int iz = (int)Math.Round(tz * (nz - 1));

	ix = Math.Max(0, Math.Min(nx - 1, ix));
	iy = Math.Max(0, Math.Min(ny - 1, iy));
	iz = Math.Max(0, Math.Min(nz - 1, iz));

	return ToIndex(ix, iy, iz, ny, nz);
}

double SampleTrailField(Point3d p, DualStateSim s)
{
	int i = ClosestVoxelIndex(p, s.Box, s.NX, s.NY, s.NZ);
	if (i < 0 || i >= s.TrailField.Length) return 0.0;
	return s.TrailField[i];
}

double LocalFoodAttraction(Point3d p, Point3d foodPt, double foodIntensity, double foodPropagation, double spacing, double domainSize)
{
	if (!foodPt.IsValid) return 0.0;
	if (foodIntensity <= 0.0) return 0.0;

	foodPropagation = Clamp01(foodPropagation);

	double radius = Math.Max(spacing * 1.5, spacing + foodPropagation * domainSize * 0.10);

	double d = p.DistanceTo(foodPt);
	if (d >= radius) return 0.0;

	double t = d / radius;
	double sharpness = 5.0;

	double value = foodIntensity * Math.Pow(1.0 - t, sharpness);

	return Clamp01(value);
}

Point3d ClampToBox(Point3d p, BoundingBox box)
{
	double x = Math.Max(box.Min.X, Math.Min(box.Max.X, p.X));
	double y = Math.Max(box.Min.Y, Math.Min(box.Max.Y, p.Y));
	double z = Math.Max(box.Min.Z, Math.Min(box.Max.Z, p.Z));
	return new Point3d(x, y, z);
}

Vector3d Rotate(Vector3d v, Vector3d axis, double angle)
{
	if (!axis.IsValid || axis.Length < Rhino.RhinoMath.ZeroTolerance)
		return v;

	axis.Unitize();
	Transform t = Transform.Rotation(angle, axis, Point3d.Origin);
	v.Transform(t);
	return v;
}

Vector3d RandomUnit(Random r)
{
	Vector3d v = new Vector3d(
		r.NextDouble() * 2.0 - 1.0,
		r.NextDouble() * 2.0 - 1.0,
		r.NextDouble() * 2.0 - 1.0
	);

	if (v.Length < Rhino.RhinoMath.ZeroTolerance)
		v = Vector3d.XAxis;

	v.Unitize();
	return v;
}

Vector3d ProjectToPlane(Vector3d v, Vector3d normal)
{
	if (!normal.IsValid || normal.Length < Rhino.RhinoMath.ZeroTolerance)
		return v;

	Vector3d n = normal;
	n.Unitize();
	return v - (v * n) * n;
}

Vector3d AnyPerpendicular(Vector3d n)
{
	n.Unitize();
	Vector3d test = Math.Abs(n * Vector3d.XAxis) < 0.9 ? Vector3d.XAxis : Vector3d.YAxis;
	Vector3d p = Vector3d.CrossProduct(n, test);
	if (p.Length < Rhino.RhinoMath.ZeroTolerance)
		p = Vector3d.CrossProduct(n, Vector3d.ZAxis);
	if (p.Length < Rhino.RhinoMath.ZeroTolerance)
		p = Vector3d.XAxis;
	p.Unitize();
	return p;
}

int NearestFoodIndex(Point3d p, List<Point3d> food)
{
	if (food == null || food.Count == 0) return 0;

	double best = double.MaxValue;
	int bestIdx = 0;

	for (int i = 0; i < food.Count; i++)
	{
		double d = p.DistanceToSquared(food[i]);
		if (d < best)
		{
			best = d;
			bestIdx = i;
		}
	}

	return bestIdx;
}

int RandomDifferentIndex(int current, int count, Random rnd)
{
	if (count <= 1) return current;

	int idx = current;
	int guard = 0;

	while (idx == current && guard < 100)
	{
		idx = rnd.Next(count);
		guard++;
	}

	return idx;
}


// ============================================================
// STORAGE TYPES
// ============================================================

class DualStateSim
{
	public string ConfigKey;
	public BoundingBox Box;
	public int NX;
	public int NY;
	public int NZ;
	public double Spacing;
	public int StepCount;

	public List<Point3d> VoxelPts;

	public double[] FoodField;
	public double[] TrailField;

	public List<Point3d> AgentPts;
	public List<Vector3d> AgentDirs;
	public List<int> AgentSource;
	public List<int> AgentTarget;
	public List<bool> AgentLoaded;
	public List<int> AgentStuckCount;

	public List<Queue<Point3d>> Trails;
	public List<Curve> NakedEdges;

	public Random Random;
}

static class SolverMemory
{
	public static Dictionary<string, DualStateSim> Store;
}
# ---------- end c_script ----------

# ---- group: Stream GH Mesh to Rhino for Sketching
content_cache = ContentCache(Name="mesh", Content=mesh, Action=Button())  # -> Name, Content, Result
python_3_script = Python3Script(Run=Toggle(False))  # inputs Run: Boolean
# ---------- python_3_script: Python ----------
import Rhino
import System.Drawing as sd

def reset_layers():
    doc = Rhino.RhinoDoc.ActiveDoc
    if doc is None:
        return

    # Delete all objects
    all_objects = doc.Objects.GetObjectList(Rhino.DocObjects.ObjectType.AnyObject)
    ids = [obj.Id for obj in all_objects]
    for obj_id in ids:
        doc.Objects.Delete(obj_id, True)

    # Create or update Limit
    limit_index = doc.Layers.FindByFullPath("Limit", -1)
    if limit_index < 0:
        limit_layer = Rhino.DocObjects.Layer()
        limit_layer.Name = "Limit"
        limit_layer.Color = sd.Color.Black
        limit_layer.IsVisible = True
        limit_index = doc.Layers.Add(limit_layer)
    else:
        layer = doc.Layers[limit_index]
        layer.Color = sd.Color.Black
        layer.IsVisible = True
        doc.Layers.Modify(layer, limit_index, True)

    # Create or update Start
    start_index = doc.Layers.FindByFullPath("Start", -1)
    if start_index < 0:
        start_layer = Rhino.DocObjects.Layer()
        start_layer.Name = "Start"
        start_layer.Color = sd.Color.Black
        start_layer.IsVisible = True
        start_index = doc.Layers.Add(start_layer)
    else:
        layer = doc.Layers[start_index]
        layer.Color = sd.Color.Black
        layer.IsVisible = True
        doc.Layers.Modify(layer, start_index, True)

    # Set Limit as current layer
    doc.Layers.SetCurrentLayerIndex(limit_index, True)

    # Delete all other layers
    for i in range(doc.Layers.Count - 1, -1, -1):
        layer = doc.Layers[i]
        if layer and not layer.IsDeleted and not layer.IsReference:
            if layer.Name not in ["Limit", "Start"]:
                try:
                    doc.Layers.Delete(i, True)
                except:
                    pass

    doc.Views.Redraw()

if Run:
    reset_layers()
# ---------- end python_3_script ----------

# ----
example = Curve([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])

# ---- group: Limit Curve (Closed)
geometry_pipeline = GeometryPipeline(
    GroupByLayer=False,
    GroupByType=False,
    IncludeHidden=True,
    IncludeLocked=True,
    LayerFilter="Limit",
    NameFilter="*",
    SublayerFiltering=True,
    TypeFilter=4)
curve = Curve(geometry_pipeline)
closed = Closed(Curve=example)  # -> Closed, Periodic
panel = Panel(closed.Closed)
c_script_2 = CSharpScript(Curve=example, Mesh=mesh)  # -> PulledCurve; inputs Curve: list of Curve, Mesh: Mesh
# ---------- c_script_2: C# ----------
using System;
using System.Collections.Generic;
using System.Threading.Tasks;
using Rhino;
using Rhino.Geometry;

public class Script_Instance : GH_ScriptInstance
{
  private void RunScript(List<Curve> Curve, Mesh Mesh, ref object PulledCurve)
  {
    if (Curve == null || Mesh == null || Curve.Count == 0)
    {
      PulledCurve = null;
      return;
    }

    double tol = RhinoDoc.ActiveDoc != null
      ? RhinoDoc.ActiveDoc.ModelAbsoluteTolerance
      : 0.01;

    Curve[] results = new Curve[Curve.Count];

    Parallel.For(0, Curve.Count, i =>
    {
      Curve crv = Curve[i];

      if (crv == null)
      {
        results[i] = null;
        return;
      }

      try
      {
        Curve pulled = crv.PullToMesh(Mesh, tol);
        results[i] = pulled;
      }
      catch
      {
        results[i] = null;
      }
    });

    PulledCurve = results;
  }
}
# ---------- end c_script_2 ----------
curve_mesh_trim = Python3Script(Mesh=mesh, Polyline=c_script_2)  # -> out, MeshOut; inputs Mesh: Mesh, Polyline: Polyline
# ---------- curve_mesh_trim: Python ----------
import Rhino.Geometry as rg
from collections import deque
import scriptcontext as sc

# ------------------------------------------------------------
# Helpers
# ------------------------------------------------------------

def get_polyline_points(obj):
    if obj is None:
        return None

    if isinstance(obj, rg.Polyline):
        if obj.IsClosed and len(obj) >= 4:
            return list(obj)
        return None

    if isinstance(obj, rg.PolylineCurve):
        ok, pl = obj.TryGetPolyline()
        if ok and pl.IsClosed and len(pl) >= 4:
            return list(pl)
        return None

    if isinstance(obj, rg.Curve):
        ok, pl = obj.TryGetPolyline()
        if ok and pl.IsClosed and len(pl) >= 4:
            return list(pl)
        return None

    return None


def polyline_center(pts):
    if len(pts) > 1 and pts[0].DistanceTo(pts[-1]) < 1e-9:
        pts = pts[:-1]

    n = len(pts)
    if n == 0:
        return None

    sx = sy = sz = 0.0
    for p in pts:
        sx += p.X
        sy += p.Y
        sz += p.Z

    return rg.Point3d(sx / n, sy / n, sz / n)


def mesh_cache_key(mesh):
    return (mesh.Vertices.Count, mesh.Faces.Count)


def build_face_adjacency(mesh):
    adj = [[] for _ in range(mesh.Faces.Count)]
    topo_edges = mesh.TopologyEdges

    for ei in range(topo_edges.Count):
        connected = topo_edges.GetConnectedFaces(ei)
        if connected and len(connected) == 2:
            a = connected[0]
            b = connected[1]
            adj[a].append(b)
            adj[b].append(a)

    return adj


def get_cached_adjacency(mesh):
    key = ("mesh_adj", mesh_cache_key(mesh))
    if key in sc.sticky:
        return sc.sticky[key]

    adj = build_face_adjacency(mesh)
    sc.sticky[key] = adj
    return adj


def boundary_faces_from_polyline_vertices(mesh, pts):
    boundary = set()

    # uses only existing polyline vertices for speed
    for p in pts[:-1]:
        mp = mesh.ClosestMeshPoint(p, 0.0)
        if mp:
            fi = mp.FaceIndex
            if fi >= 0:
                boundary.add(fi)

    return boundary


def flood_fill_inside(adjacency, boundary_faces, start_face):
    if start_face < 0 or start_face in boundary_faces:
        return set()

    visited = set([start_face])
    q = deque([start_face])

    while q:
        f = q.popleft()
        for nb in adjacency[f]:
            if nb in visited or nb in boundary_faces:
                continue
            visited.add(nb)
            q.append(nb)

    return visited


def keep_relevant_boundary_faces(boundary_faces, inside_faces, adjacency):
    keep_boundary = set()

    for f in boundary_faces:
        inside_n = 0
        outside_n = 0

        for nb in adjacency[f]:
            if nb in inside_faces:
                inside_n += 1
            elif nb not in boundary_faces:
                outside_n += 1

        # keep only if boundary face is biased toward the inside
        if inside_n > outside_n:
            keep_boundary.add(f)

    return keep_boundary


def extract_faces(mesh, keep_faces):
    new_mesh = rg.Mesh()
    vmap = {}

    for fi in keep_faces:
        f = mesh.Faces[fi]

        ids = [f.A, f.B, f.C] if f.IsTriangle else [f.A, f.B, f.C, f.D]
        new_ids = []

        for old_vi in ids:
            if old_vi not in vmap:
                v = mesh.Vertices[old_vi]
                vmap[old_vi] = new_mesh.Vertices.Add(v.X, v.Y, v.Z)
            new_ids.append(vmap[old_vi])

        if f.IsTriangle:
            new_mesh.Faces.AddFace(new_ids[0], new_ids[1], new_ids[2])
        else:
            new_mesh.Faces.AddFace(new_ids[0], new_ids[1], new_ids[2], new_ids[3])

    new_mesh.Vertices.CullUnused()
    new_mesh.Normals.ComputeNormals()
    new_mesh.Compact()
    return new_mesh


# ------------------------------------------------------------
# Main
# ------------------------------------------------------------

MeshOut = None

if Mesh and Polyline:
    pts = get_polyline_points(Polyline)

    if pts:
        center_pt = polyline_center(pts)
        adjacency = get_cached_adjacency(Mesh)
        boundary_faces = boundary_faces_from_polyline_vertices(Mesh, pts)

        mp = Mesh.ClosestMeshPoint(center_pt, 0.0)
        if mp:
            start_face = mp.FaceIndex
            inside_faces = flood_fill_inside(adjacency, boundary_faces, start_face)

            if inside_faces:
                kept_boundary_faces = keep_relevant_boundary_faces(boundary_faces, inside_faces, adjacency)
                final_faces = inside_faces.union(kept_boundary_faces)
                MeshOut = extract_faces(Mesh, final_faces)
# ---------- end curve_mesh_trim ----------
mesh_join = MeshJoin(Meshes=curve_mesh_trim.MeshOut)
mesh_2 = Mesh(mesh_join)

# ----
example_2 = Curve([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])
c_script_3 = CSharpScript(
    VoxelDensity=50,
    FoodIntensity=1,
    FoodPropagation=0.01,
    Speed=0.4,
    SensorDistance=5,
    SensorAngle=45,
    RotationAngle=15,
    Deposit=1,
    Reset=False)  # -> out, Voxels, VoxelValues, AgentsOut, Trail; inputs BoundingBox: Box, VoxelDensity: Double, MeshConstraint: Mesh, Food: list of Point3d, FoodIntensity: Double, FoodPropagation: Double, Agents: list of Point3d, Speed: Double, SensorDistance: Double, SensorAngle: Double, RotationAngle: Double, Deposit: Double, Reset: Boolean; disabled
# ---------- c_script_3: C# ----------
using System;
using System.Collections.Generic;
using Rhino.Geometry;
using Grasshopper.Kernel.Data;
using Grasshopper.Kernel.Types;

// ============================================================
// PERSISTENT STORAGE
// ============================================================
if (SolverState.Store == null)
	SolverState.Store = new Dictionary<string, SimState>();

string key = "default_solver";

if (Reset || !SolverState.Store.ContainsKey(key))
{
	var state = new SimState();

	// ----------------------------
	// Basic checks
	// ----------------------------
	if (!BoundingBox.IsValid)
	{
		Voxels = new List<Point3d>();
		VoxelValues = new List<double>();
		AgentsOut = new List<Point3d>();
		Trail = new GH_Structure<GH_Point>();
		return;
	}

	if (VoxelDensity < 2) VoxelDensity = 2;
	if (Food == null) Food = new List<Point3d>();
	if (Agents == null) Agents = new List<Point3d>();

	state.Box = BoundingBox.BoundingBox;

	double sx = state.Box.Max.X - state.Box.Min.X;
	double sy = state.Box.Max.Y - state.Box.Min.Y;
	double sz = state.Box.Max.Z - state.Box.Min.Z;
	double maxDim = Math.Max(sx, Math.Max(sy, sz));

	if (maxDim <= Rhino.RhinoMath.ZeroTolerance)
	{
		Voxels = new List<Point3d>();
		VoxelValues = new List<double>();
		AgentsOut = new List<Point3d>();
		Trail = new GH_Structure<GH_Point>();
		return;
	}

	state.Spacing = maxDim / VoxelDensity;
	if (state.Spacing <= Rhino.RhinoMath.ZeroTolerance)
	{
		Voxels = new List<Point3d>();
		VoxelValues = new List<double>();
		AgentsOut = new List<Point3d>();
		Trail = new GH_Structure<GH_Point>();
		return;
	}

	state.NX = Math.Max(2, (int)Math.Round(sx / state.Spacing) + 1);
	state.NY = Math.Max(2, (int)Math.Round(sy / state.Spacing) + 1);
	state.NZ = Math.Max(2, (int)Math.Round(sz / state.Spacing) + 1);

	state.VoxelPts = new List<Point3d>();
	state.VoxelVals = new List<double>();
	state.AgentPts = new List<Point3d>();
	state.AgentDirs = new List<Vector3d>();
	state.TrailTree = new GH_Structure<GH_Point>();

	// ----------------------------
	// Build voxel grid
	// ----------------------------
	for (int i = 0; i < state.NX; i++)
	{
		double tx = (state.NX == 1) ? 0.0 : (double)i / (state.NX - 1);
		for (int j = 0; j < state.NY; j++)
		{
			double ty = (state.NY == 1) ? 0.0 : (double)j / (state.NY - 1);
			for (int k = 0; k < state.NZ; k++)
			{
				double tz = (state.NZ == 1) ? 0.0 : (double)k / (state.NZ - 1);
				Point3d p = BoundingBox.PointAt(tx, ty, tz);
				state.VoxelPts.Add(p);
				state.VoxelVals.Add(0.0);
			}
		}
	}

	// ----------------------------
	// Food field
	// ----------------------------
	FoodPropagation = Math.Max(0.0, Math.Min(1.0, FoodPropagation));
	FoodIntensity = Math.Max(0.0, FoodIntensity);

	if (Food.Count > 0 && FoodIntensity > 0)
	{
		if (FoodPropagation <= 0.0001)
		{
			foreach (Point3d f in Food)
			{
				int idx = ClosestVoxelIndex(f, state.Box, state.NX, state.NY, state.NZ);
				if (idx >= 0 && idx < state.VoxelVals.Count)
					state.VoxelVals[idx] = Math.Min(1.0, state.VoxelVals[idx] + FoodIntensity);
			}
		}
		else
		{
			double sigma = state.Spacing + FoodPropagation * maxDim * 0.35;

			for (int i = 0; i < state.VoxelPts.Count; i++)
			{
				double value = 0.0;
				Point3d vp = state.VoxelPts[i];

				for (int f = 0; f < Food.Count; f++)
				{
					double d = vp.DistanceTo(Food[f]);
					double contrib = FoodIntensity * Math.Exp(-(d * d) / (2.0 * sigma * sigma));
					value += contrib;
				}

				state.VoxelVals[i] = Math.Min(1.0, value);
			}
		}
	}

	// ----------------------------
	// Initialize agents
	// ----------------------------
	Random rndInit = new Random(Guid.NewGuid().GetHashCode());

	for (int a = 0; a < Agents.Count; a++)
	{
		Point3d p = Agents[a];

		if (MeshConstraint != null && MeshConstraint.IsValid)
		{
			MeshPoint mp0 = MeshConstraint.ClosestMeshPoint(p, 0.0);
			if (mp0 != null) p = mp0.Point;
		}
		else
		{
			p = ClampToBox(p, state.Box);
		}

		Vector3d dir = RandomUnit(rndInit);
		Vector3d axis = Vector3d.ZAxis;

		if (MeshConstraint != null && MeshConstraint.IsValid)
		{
			MeshPoint mpN = MeshConstraint.ClosestMeshPoint(p, 0.0);
			if (mpN != null)
			{
				Vector3d n = MeshConstraint.NormalAt(mpN);
				if (n.IsValid && n.Length > Rhino.RhinoMath.ZeroTolerance)
				{
					n.Unitize();
					axis = n;
					dir = ProjectToPlane(dir, n);
					if (dir.Length < Rhino.RhinoMath.ZeroTolerance)
						dir = AnyPerpendicular(n);
					dir.Unitize();
				}
			}
		}

		state.AgentPts.Add(p);
		state.AgentDirs.Add(dir);

		var path = new GH_Path(a);
		state.TrailTree.Append(new GH_Point(p), path);
	}

	SolverState.Store[key] = state;
}

// ============================================================
// ADVANCE ONE STEP
// ============================================================
var s = SolverState.Store[key];

Deposit = Math.Max(0.0, Math.Min(1.0, Deposit));
double sensorRad = Rhino.RhinoMath.ToRadians(SensorAngle);
double rotateRad = Rhino.RhinoMath.ToRadians(RotationAngle);

for (int a = 0; a < s.AgentPts.Count; a++)
{
	Point3d p = s.AgentPts[a];
	Vector3d dir = s.AgentDirs[a];

	if (dir.Length < Rhino.RhinoMath.ZeroTolerance)
		dir = Vector3d.XAxis;

	dir.Unitize();

	Vector3d axis = Vector3d.ZAxis;

	if (MeshConstraint != null && MeshConstraint.IsValid)
	{
		MeshPoint mpN = MeshConstraint.ClosestMeshPoint(p, 0.0);
		if (mpN != null)
		{
			Vector3d n = MeshConstraint.NormalAt(mpN);
			if (n.IsValid && n.Length > Rhino.RhinoMath.ZeroTolerance)
			{
				n.Unitize();
				axis = n;
			}
		}
	}

	Vector3d left = Rotate(dir, axis, sensorRad);
	Vector3d right = Rotate(dir, axis, -sensorRad);

	double vF = SampleField(p + dir * SensorDistance, s.Box, s.NX, s.NY, s.NZ, s.VoxelVals);
	double vL = SampleField(p + left * SensorDistance, s.Box, s.NX, s.NY, s.NZ, s.VoxelVals);
	double vR = SampleField(p + right * SensorDistance, s.Box, s.NX, s.NY, s.NZ, s.VoxelVals);

	if (vL > vF && vL > vR)
		dir = Rotate(dir, axis, rotateRad);
	else if (vR > vF && vR > vL)
		dir = Rotate(dir, axis, -rotateRad);

	dir.Unitize();

	Point3d next = p + dir * Speed;

	if (MeshConstraint != null && MeshConstraint.IsValid)
	{
		MeshPoint mp = MeshConstraint.ClosestMeshPoint(next, 0.0);
		if (mp != null)
			next = mp.Point;
	}
	else
	{
		next = ClampToBox(next, s.Box);
	}

	int vi = ClosestVoxelIndex(next, s.Box, s.NX, s.NY, s.NZ);
	if (vi >= 0 && vi < s.VoxelVals.Count)
		s.VoxelVals[vi] = Math.Min(1.0, s.VoxelVals[vi] + Deposit);

	s.AgentPts[a] = next;
	s.AgentDirs[a] = dir;

	var path = new GH_Path(a);
	s.TrailTree.Append(new GH_Point(next), path);
}

// ============================================================
// OUTPUTS
// ============================================================
Voxels = s.VoxelPts;
VoxelValues = s.VoxelVals;
AgentsOut = s.AgentPts;
Trail = s.TrailTree;


// ============================================================
// HELPERS
// ============================================================
int ClosestVoxelIndex(Point3d p, BoundingBox box, int cx, int cy, int cz)
{
	double dx = Math.Max(box.Max.X - box.Min.X, Rhino.RhinoMath.ZeroTolerance);
	double dy = Math.Max(box.Max.Y - box.Min.Y, Rhino.RhinoMath.ZeroTolerance);
	double dz = Math.Max(box.Max.Z - box.Min.Z, Rhino.RhinoMath.ZeroTolerance);

	double tx = (p.X - box.Min.X) / dx;
	double ty = (p.Y - box.Min.Y) / dy;
	double tz = (p.Z - box.Min.Z) / dz;

	tx = Math.Max(0.0, Math.Min(1.0, tx));
	ty = Math.Max(0.0, Math.Min(1.0, ty));
	tz = Math.Max(0.0, Math.Min(1.0, tz));

	int ix = (int)Math.Round(tx * (cx - 1));
	int iy = (int)Math.Round(ty * (cy - 1));
	int iz = (int)Math.Round(tz * (cz - 1));

	ix = Math.Max(0, Math.Min(cx - 1, ix));
	iy = Math.Max(0, Math.Min(cy - 1, iy));
	iz = Math.Max(0, Math.Min(cz - 1, iz));

	return ix * cy * cz + iy * cz + iz;
}

double SampleField(Point3d p, BoundingBox box, int cx, int cy, int cz, List<double> values)
{
	int idx = ClosestVoxelIndex(p, box, cx, cy, cz);
	if (idx < 0 || idx >= values.Count) return 0.0;
	return values[idx];
}

Point3d ClampToBox(Point3d p, BoundingBox box)
{
	double x = Math.Max(box.Min.X, Math.Min(box.Max.X, p.X));
	double y = Math.Max(box.Min.Y, Math.Min(box.Max.Y, p.Y));
	double z = Math.Max(box.Min.Z, Math.Min(box.Max.Z, p.Z));
	return new Point3d(x, y, z);
}

Vector3d Rotate(Vector3d v, Vector3d axis, double angle)
{
	Transform t = Transform.Rotation(angle, axis, Point3d.Origin);
	v.Transform(t);
	return v;
}

Vector3d RandomUnit(Random r)
{
	Vector3d v = new Vector3d(
		r.NextDouble() * 2.0 - 1.0,
		r.NextDouble() * 2.0 - 1.0,
		r.NextDouble() * 2.0 - 1.0
	);

	if (v.Length < Rhino.RhinoMath.ZeroTolerance)
		v = Vector3d.XAxis;

	v.Unitize();
	return v;
}

Vector3d ProjectToPlane(Vector3d v, Vector3d normal)
{
	Vector3d n = normal;
	n.Unitize();
	return v - (v * n) * n;
}

Vector3d AnyPerpendicular(Vector3d n)
{
	n.Unitize();
	Vector3d test = Math.Abs(n * Vector3d.XAxis) < 0.9 ? Vector3d.XAxis : Vector3d.YAxis;
	Vector3d p = Vector3d.CrossProduct(n, test);
	if (p.Length < Rhino.RhinoMath.ZeroTolerance)
		p = Vector3d.CrossProduct(n, Vector3d.ZAxis);
	if (p.Length < Rhino.RhinoMath.ZeroTolerance)
		p = Vector3d.XAxis;
	p.Unitize();
	return p;
}

// ============================================================
// STATE CLASSES
// ============================================================
class SimState
{
	public List<Point3d> VoxelPts;
	public List<double> VoxelVals;
	public List<Point3d> AgentPts;
	public List<Vector3d> AgentDirs;
	public GH_Structure<GH_Point> TrailTree;
	public BoundingBox Box;
	public int NX;
	public int NY;
	public int NZ;
	public double Spacing;
}

static class SolverState
{
	public static Dictionary<string, SimState> Store;
}
# ---------- end c_script_3 ----------
c_script_4 = CSharpScript(
    Resolution=50,
    StepSize=0.6,
    SensorDistance=6,
    SensorAngle=30,
    TurnAngle=15,
    Deposit=0.08,
    Decay=0.03,
    Diffuse=0.12,
    Reset=False)  # -> out, FieldPts, FieldVals, AgentsOut, Trail; inputs Bounds: Box, MeshConstraint: Mesh, Agents: list of Point3d, Resolution: Int32, StepSize: Double, SensorDistance: Double, SensorAngle: Double, TurnAngle: Double, Deposit: Double, Decay: Double, Diffuse: Double, Wrap: Boolean, Reset: Boolean; disabled
# ---------- c_script_4: C# ----------
using System;
using System.Collections.Generic;
using System.Threading.Tasks;
using Rhino.Geometry;
using Grasshopper.Kernel.Data;
using Grasshopper.Kernel.Types;

// ============================================================
// STORAGE
// ============================================================
if (SolverState.Store == null)
	SolverState.Store = new Dictionary<string, SimState>();

string key = "simple_slime_mesh_fast";

if (Reset || !SolverState.Store.ContainsKey(key))
{
	var s = new SimState();

	if (!Bounds.IsValid)
	{
		AgentsOut = new List<Point3d>();
		FieldPts = new List<Point3d>();
		FieldVals = new List<double>();
		Trail = new GH_Structure<GH_Point>();
		return;
	}

	if (Resolution < 2) Resolution = 2;
	if (Agents == null) Agents = new List<Point3d>();

	s.Box = Bounds.BoundingBox;

	double sx = s.Box.Max.X - s.Box.Min.X;
	double sy = s.Box.Max.Y - s.Box.Min.Y;
	double sz = s.Box.Max.Z - s.Box.Min.Z;
	double maxDim = Math.Max(sx, Math.Max(sy, sz));

	if (maxDim <= Rhino.RhinoMath.ZeroTolerance)
	{
		AgentsOut = new List<Point3d>();
		FieldPts = new List<Point3d>();
		FieldVals = new List<double>();
		Trail = new GH_Structure<GH_Point>();
		return;
	}

	s.Spacing = maxDim / Resolution;
	if (s.Spacing <= Rhino.RhinoMath.ZeroTolerance)
	{
		AgentsOut = new List<Point3d>();
		FieldPts = new List<Point3d>();
		FieldVals = new List<double>();
		Trail = new GH_Structure<GH_Point>();
		return;
	}

	s.NX = Math.Max(2, (int)Math.Round(sx / s.Spacing) + 1);
	s.NY = Math.Max(2, (int)Math.Round(sy / s.Spacing) + 1);
	s.NZ = Math.Max(2, (int)Math.Round(sz / s.Spacing) + 1);

	int count = s.NX * s.NY * s.NZ;

	s.FieldPts = new List<Point3d>(count);
	s.FieldVals = new double[count];
	s.NextFieldVals = new double[count];
	s.AgentPts = new List<Point3d>();
	s.AgentDirs = new List<Vector3d>();
	s.TrailTree = new GH_Structure<GH_Point>();

	for (int i = 0; i < s.NX; i++)
	{
		double tx = (s.NX == 1) ? 0.0 : (double)i / (s.NX - 1);
		for (int j = 0; j < s.NY; j++)
		{
			double ty = (s.NY == 1) ? 0.0 : (double)j / (s.NY - 1);
			for (int k = 0; k < s.NZ; k++)
			{
				double tz = (s.NZ == 1) ? 0.0 : (double)k / (s.NZ - 1);
				s.FieldPts.Add(Bounds.PointAt(tx, ty, tz));
			}
		}
	}

	Random rnd = new Random(Guid.NewGuid().GetHashCode());

	for (int i = 0; i < Agents.Count; i++)
	{
		Point3d p = Agents[i];
		Vector3d dir = RandomUnit(rnd);

		if (MeshConstraint != null && MeshConstraint.IsValid)
		{
			MeshPoint mp = MeshConstraint.ClosestMeshPoint(p, 0.0);
			if (mp != null)
			{
				p = mp.Point;
				Vector3d n = MeshConstraint.NormalAt(mp);
				if (n.IsValid && n.Length > Rhino.RhinoMath.ZeroTolerance)
				{
					n.Unitize();
					dir = ProjectToPlane(dir, n);
					if (dir.Length < Rhino.RhinoMath.ZeroTolerance)
						dir = AnyPerpendicular(n);
					dir.Unitize();
				}
			}
			else
			{
				p = ClampToBox(p, s.Box);
			}
		}
		else
		{
			p = ClampToBox(p, s.Box);
			dir.Z = 0.0;
			if (dir.Length < Rhino.RhinoMath.ZeroTolerance) dir = Vector3d.XAxis;
			dir.Unitize();
		}

		s.AgentPts.Add(p);
		s.AgentDirs.Add(dir);

		var path = new GH_Path(i);
		s.TrailTree.Append(new GH_Point(p), path);
	}

	SolverState.Store[key] = s;
}

// ============================================================
// STEP
// ============================================================
var state = SolverState.Store[key];

Deposit = Math.Max(0.0, Deposit);
Decay = Math.Max(0.0, Math.Min(1.0, Decay));
Diffuse = Math.Max(0.0, Math.Min(1.0, Diffuse));

double sensorRad = Rhino.RhinoMath.ToRadians(SensorAngle);
double turnRad = Rhino.RhinoMath.ToRadians(TurnAngle);

// ------------------------------------------------------------
// Diffuse + decay field
// safe to parallelize
// ------------------------------------------------------------
int NX = state.NX;
int NY = state.NY;
int NZ = state.NZ;
double[] field = state.FieldVals;
double[] nextField = state.NextFieldVals;

Parallel.For(0, NX, ix =>
{
	for (int iy = 0; iy < NY; iy++)
	{
		for (int iz = 0; iz < NZ; iz++)
		{
			int idx = ToIndex(ix, iy, iz, NY, NZ);
			double center = field[idx];

			double sum = center;
			int count = 1;

			if (ix > 0)      { sum += field[ToIndex(ix - 1, iy, iz, NY, NZ)]; count++; }
			if (ix < NX - 1) { sum += field[ToIndex(ix + 1, iy, iz, NY, NZ)]; count++; }
			if (iy > 0)      { sum += field[ToIndex(ix, iy - 1, iz, NY, NZ)]; count++; }
			if (iy < NY - 1) { sum += field[ToIndex(ix, iy + 1, iz, NY, NZ)]; count++; }
			if (iz > 0)      { sum += field[ToIndex(ix, iy, iz - 1, NY, NZ)]; count++; }
			if (iz < NZ - 1) { sum += field[ToIndex(ix, iy, iz + 1, NY, NZ)]; count++; }

			double avg = sum / count;
			double v = center * (1.0 - Diffuse) + avg * Diffuse;
			v *= (1.0 - Decay);

			nextField[idx] = (v < 0.0) ? 0.0 : ((v > 1.0) ? 1.0 : v);
		}
	}
});

// swap arrays
state.FieldVals = nextField;
state.NextFieldVals = field;
field = state.FieldVals;

// ------------------------------------------------------------
// Move agents
// keep sequential because of deposit collisions
// ------------------------------------------------------------
Random rndStep = new Random(Guid.NewGuid().GetHashCode());

for (int a = 0; a < state.AgentPts.Count; a++)
{
	Point3d p = state.AgentPts[a];
	Vector3d dir = state.AgentDirs[a];

	if (dir.Length < Rhino.RhinoMath.ZeroTolerance)
		dir = Vector3d.XAxis;
	dir.Unitize();

	Vector3d axis = Vector3d.ZAxis;

	if (MeshConstraint != null && MeshConstraint.IsValid)
	{
		MeshPoint mp = MeshConstraint.ClosestMeshPoint(p, 0.0);
		if (mp != null)
		{
			p = mp.Point;
			Vector3d n = MeshConstraint.NormalAt(mp);
			if (n.IsValid && n.Length > Rhino.RhinoMath.ZeroTolerance)
			{
				n.Unitize();
				axis = n;
				dir = ProjectToPlane(dir, axis);
				if (dir.Length < Rhino.RhinoMath.ZeroTolerance)
					dir = AnyPerpendicular(axis);
				dir.Unitize();
			}
		}
	}
	else
	{
		dir.Z = 0.0;
		if (dir.Length < Rhino.RhinoMath.ZeroTolerance) dir = Vector3d.XAxis;
		dir.Unitize();
	}

	// SENSOR DIRECTIONS IN TANGENT PLANE
	Vector3d left = Rotate(dir, axis, sensorRad);
	Vector3d right = Rotate(dir, axis, -sensorRad);

	if (MeshConstraint != null && MeshConstraint.IsValid)
	{
		left = ProjectToPlane(left, axis);
		right = ProjectToPlane(right, axis);

		if (left.Length < Rhino.RhinoMath.ZeroTolerance) left = AnyPerpendicular(axis);
		if (right.Length < Rhino.RhinoMath.ZeroTolerance) right = AnyPerpendicular(axis);

		left.Unitize();
		right.Unitize();
	}

	// IMPORTANT:
	// sample directly in space, do NOT ClosestMeshPoint for sensors
	double f = SampleField(p + dir * SensorDistance, state);
	double l = SampleField(p + left * SensorDistance, state);
	double r = SampleField(p + right * SensorDistance, state);

	if (f > l && f > r)
	{
	}
	else if (f < l && f < r)
	{
		if (rndStep.NextDouble() < 0.5)
			dir = Rotate(dir, axis, turnRad);
		else
			dir = Rotate(dir, axis, -turnRad);
	}
	else if (l > r)
	{
		dir = Rotate(dir, axis, turnRad);
	}
	else if (r > l)
	{
		dir = Rotate(dir, axis, -turnRad);
	}

	if (MeshConstraint != null && MeshConstraint.IsValid)
	{
		dir = ProjectToPlane(dir, axis);
		if (dir.Length < Rhino.RhinoMath.ZeroTolerance)
			dir = AnyPerpendicular(axis);
	}
	else
	{
		dir.Z = 0.0;
		if (dir.Length < Rhino.RhinoMath.ZeroTolerance) dir = Vector3d.XAxis;
	}
	dir.Unitize();

	Point3d next = p + dir * StepSize;

	if (MeshConstraint != null && MeshConstraint.IsValid)
	{
		MeshPoint mpNext = MeshConstraint.ClosestMeshPoint(next, 0.0);
		if (mpNext != null)
			next = mpNext.Point;
		else
			next = p;
	}
	else
	{
		if (Wrap)
			next = WrapPoint(next, state.Box);
		else
			next = ClampToBox(next, state.Box);
	}

	int vi = ClosestVoxelIndex(next, state.Box, state.NX, state.NY, state.NZ);
	if (vi >= 0 && vi < state.FieldVals.Length)
	{
		double nv = state.FieldVals[vi] + Deposit;
		state.FieldVals[vi] = (nv > 1.0) ? 1.0 : nv;
	}

	state.AgentPts[a] = next;
	state.AgentDirs[a] = dir;

	var path = new GH_Path(a);
	state.TrailTree.Append(new GH_Point(next), path);
}

// ============================================================
// OUTPUTS
// ============================================================
AgentsOut = state.AgentPts;
FieldPts = state.FieldPts;

List<double> outVals = new List<double>(state.FieldVals.Length);
for (int i = 0; i < state.FieldVals.Length; i++)
	outVals.Add(state.FieldVals[i]);
FieldVals = outVals;

Trail = state.TrailTree;

// ============================================================
// HELPERS
// ============================================================
int ToIndex(int ix, int iy, int iz, int cy, int cz)
{
	return ix * cy * cz + iy * cz + iz;
}

double SampleField(Point3d p, SimState s)
{
	int idx = ClosestVoxelIndex(p, s.Box, s.NX, s.NY, s.NZ);
	if (idx < 0 || idx >= s.FieldVals.Length) return 0.0;
	return s.FieldVals[idx];
}

int ClosestVoxelIndex(Point3d p, BoundingBox box, int cx, int cy, int cz)
{
	double dx = Math.Max(box.Max.X - box.Min.X, Rhino.RhinoMath.ZeroTolerance);
	double dy = Math.Max(box.Max.Y - box.Min.Y, Rhino.RhinoMath.ZeroTolerance);
	double dz = Math.Max(box.Max.Z - box.Min.Z, Rhino.RhinoMath.ZeroTolerance);

	double tx = (p.X - box.Min.X) / dx;
	double ty = (p.Y - box.Min.Y) / dy;
	double tz = (p.Z - box.Min.Z) / dz;

	if (tx < 0.0) tx = 0.0; else if (tx > 1.0) tx = 1.0;
	if (ty < 0.0) ty = 0.0; else if (ty > 1.0) ty = 1.0;
	if (tz < 0.0) tz = 0.0; else if (tz > 1.0) tz = 1.0;

	int ix = (int)Math.Round(tx * (cx - 1));
	int iy = (int)Math.Round(ty * (cy - 1));
	int iz = (int)Math.Round(tz * (cz - 1));

	if (ix < 0) ix = 0; else if (ix >= cx) ix = cx - 1;
	if (iy < 0) iy = 0; else if (iy >= cy) iy = cy - 1;
	if (iz < 0) iz = 0; else if (iz >= cz) iz = cz - 1;

	return ix * cy * cz + iy * cz + iz;
}

Point3d ClampToBox(Point3d p, BoundingBox box)
{
	return new Point3d(
		Math.Max(box.Min.X, Math.Min(box.Max.X, p.X)),
		Math.Max(box.Min.Y, Math.Min(box.Max.Y, p.Y)),
		Math.Max(box.Min.Z, Math.Min(box.Max.Z, p.Z))
	);
}

Point3d WrapPoint(Point3d p, BoundingBox box)
{
	double x = p.X;
	double y = p.Y;
	double z = p.Z;

	double sx = box.Max.X - box.Min.X;
	double sy = box.Max.Y - box.Min.Y;
	double sz = box.Max.Z - box.Min.Z;

	if (sx > Rhino.RhinoMath.ZeroTolerance)
	{
		while (x < box.Min.X) x += sx;
		while (x > box.Max.X) x -= sx;
	}
	if (sy > Rhino.RhinoMath.ZeroTolerance)
	{
		while (y < box.Min.Y) y += sy;
		while (y > box.Max.Y) y -= sy;
	}
	if (sz > Rhino.RhinoMath.ZeroTolerance)
	{
		while (z < box.Min.Z) z += sz;
		while (z > box.Max.Z) z -= sz;
	}

	return new Point3d(x, y, z);
}

Vector3d Rotate(Vector3d v, Vector3d axis, double angle)
{
	Transform t = Transform.Rotation(angle, axis, Point3d.Origin);
	v.Transform(t);
	return v;
}

Vector3d RandomUnit(Random r)
{
	Vector3d v = new Vector3d(
		r.NextDouble() * 2.0 - 1.0,
		r.NextDouble() * 2.0 - 1.0,
		r.NextDouble() * 2.0 - 1.0
	);

	if (v.Length < Rhino.RhinoMath.ZeroTolerance)
		v = Vector3d.XAxis;

	v.Unitize();
	return v;
}

Vector3d ProjectToPlane(Vector3d v, Vector3d normal)
{
	Vector3d n = normal;
	n.Unitize();
	return v - (v * n) * n;
}

Vector3d AnyPerpendicular(Vector3d n)
{
	n.Unitize();
	Vector3d test = Math.Abs(n * Vector3d.XAxis) < 0.9 ? Vector3d.XAxis : Vector3d.YAxis;
	Vector3d p = Vector3d.CrossProduct(n, test);
	if (p.Length < Rhino.RhinoMath.ZeroTolerance)
		p = Vector3d.CrossProduct(n, Vector3d.ZAxis);
	if (p.Length < Rhino.RhinoMath.ZeroTolerance)
		p = Vector3d.XAxis;
	p.Unitize();
	return p;
}

// ============================================================
// STATE
// ============================================================
class SimState
{
	public List<Point3d> FieldPts;
	public double[] FieldVals;
	public double[] NextFieldVals;
	public List<Point3d> AgentPts;
	public List<Vector3d> AgentDirs;
	public GH_Structure<GH_Point> TrailTree;
	public BoundingBox Box;
	public int NX;
	public int NY;
	public int NZ;
	public double Spacing;
}

static class SolverState
{
	public static Dictionary<string, SimState> Store;
}
# ---------- end c_script_4 ----------
pullpolylines_parallel = CSharpScript()  # -> PulledCurve; inputs Polyline: Curve, Mesh: Mesh; disabled
# ---------- pullpolylines_parallel: C# ----------
using System;
using System.Threading.Tasks;
using Rhino.Geometry;

public class Script_Instance : GH_ScriptInstance
{
  private void RunScript(Curve Polyline, Mesh Mesh, ref object PulledCurve)
  {
    if (Polyline == null || Mesh == null)
    {
      PulledCurve = null;
      return;
    }

    Polyline pl;
    if (!Polyline.TryGetPolyline(out pl))
    {
      PulledCurve = null;
      return;
    }

    int n = pl.Count;
    if (n < 2)
    {
      PulledCurve = null;
      return;
    }

    Point3d[] pts = pl.ToArray();
    Point3d[] pulled = new Point3d[n];

    Parallel.For(0, n, i =>
    {
      Point3d cp;
      Vector3d normal;

      int faceIndex = Mesh.ClosestPoint(pts[i], out cp, out normal, double.MaxValue);

      if (faceIndex >= 0)
        pulled[i] = cp;
      else
        pulled[i] = pts[i];
    });

    PulledCurve = new PolylineCurve(pulled);
  }
}
# ---------- end pullpolylines_parallel ----------
random_agent = PopulateGeometry(Geometry=mesh_2, Count=2000, Seed=1)
mesh_3 = Mesh(mesh_2)  # disabled
food = PopulateGeometry(Geometry=mesh_2, Count=10, Seed=1)

# ---- group: Simulation Start & Reset
reset = Button()  # disabled
trigger = Trigger(Interval=20, TimerInterval=20, Target=reader)  # disabled

# ----
trigger_2 = Trigger(Interval=20, TimerInterval=20, Target=c_script_5)  # disabled
panel_2 = Panel("5")
panel_3 = Panel("30")
panel_4 = Panel("15")
c_script_5 = CSharpScript(
    MeshConstraint=mesh_2,
    Agents=random_agent,
    StepSize=0.5,
    SensorDistance=2,
    SensorAngle=40,
    TurnAngle=20,
    Deposit=0.06,
    Decay=0.035,
    Diffuse=0.12,
    SearchRadius=0.1,
    Reset=Button())  # -> FieldPts, FieldVals, AgentsOut, Trail; inputs MeshConstraint: Mesh, Agents: list of Point3d, StepSize: Double, SensorDistance: Double, SensorAngle: Double, TurnAngle: Double, Deposit: Double, Decay: Double, Diffuse: Double, SearchRadius: Double, Reset: Boolean
# ---------- c_script_5: C# ----------
using System;
using System.Collections.Generic;
using System.Threading.Tasks;
using Rhino.Geometry;
using Grasshopper.Kernel.Data;
using Grasshopper.Kernel.Types;

// ============================================================
// STORAGE
// ============================================================
if (SolverState.Store == null)
	SolverState.Store = new Dictionary<string, SimState>();

string key = "mesh_slime_native";

if (Reset || !SolverState.Store.ContainsKey(key))
{
	var s = new SimState();

	if (MeshConstraint == null || !MeshConstraint.IsValid || MeshConstraint.Vertices.Count == 0)
	{
		AgentsOut = new List<Point3d>();
		FieldPts = new List<Point3d>();
		FieldVals = new List<double>();
		Trail = new GH_Structure<GH_Point>();
		return;
	}

	if (Agents == null) Agents = new List<Point3d>();

	s.Mesh = MeshConstraint.DuplicateMesh();
	s.Mesh.Vertices.CombineIdentical(true, true);
	s.Mesh.Vertices.CullUnused();
	s.Mesh.Weld(Math.PI);
	s.Mesh.Normals.ComputeNormals();
	s.Mesh.TopologyVertices.SortEdges();

	int vCount = s.Mesh.Vertices.Count;

	s.FieldPts = new List<Point3d>(vCount);
	s.FieldVals = new double[vCount];
	s.NextFieldVals = new double[vCount];
	s.AgentPts = new List<Point3d>();
	s.AgentDirs = new List<Vector3d>();
	s.AgentVertexIds = new List<int>();
	s.TrailTree = new GH_Structure<GH_Point>();

	for (int i = 0; i < vCount; i++)
	{
		s.FieldPts.Add(s.Mesh.Vertices.Point3dAt(i));
		s.FieldVals[i] = 0.0;
		s.NextFieldVals[i] = 0.0;
	}

	// Build topology neighbor map
	int topoCount = s.Mesh.TopologyVertices.Count;
	s.TopoNeighbors = new int[topoCount][];
	s.MeshVertexToTopo = new int[vCount];

	for (int i = 0; i < vCount; i++)
		s.MeshVertexToTopo[i] = s.Mesh.TopologyVertices.TopologyVertexIndex(i);

	for (int t = 0; t < topoCount; t++)
	{
		int[] connected = s.Mesh.TopologyVertices.ConnectedTopologyVertices(t);
		if (connected == null) connected = new int[0];
		s.TopoNeighbors[t] = connected;
	}

	Random rnd = new Random(Guid.NewGuid().GetHashCode());

	for (int i = 0; i < Agents.Count; i++)
	{
		Point3d p = Agents[i];
		Vector3d dir = RandomUnit(rnd);

		MeshPoint mp = s.Mesh.ClosestMeshPoint(p, 0.0);
		if (mp != null)
		{
			p = mp.Point;

			int mv = ClosestMeshVertexFromMeshPoint(s.Mesh, mp);
			if (mv < 0) mv = ClosestMeshVertexLinear(s.Mesh, p);

			Vector3d n = MeshVertexNormalSafe(s.Mesh, mv);
			dir = ProjectToPlane(dir, n);
			if (dir.Length < Rhino.RhinoMath.ZeroTolerance)
				dir = AnyPerpendicular(n);
			dir.Unitize();

			s.AgentPts.Add(p);
			s.AgentDirs.Add(dir);
			s.AgentVertexIds.Add(mv);

			var path = new GH_Path(i);
			s.TrailTree.Append(new GH_Point(p), path);
		}
	}

	SolverState.Store[key] = s;
}

// ============================================================
// STEP
// ============================================================
var state = SolverState.Store[key];

Deposit = Math.Max(0.0, Deposit);
Decay = Math.Max(0.0, Math.Min(1.0, Decay));
Diffuse = Math.Max(0.0, Math.Min(1.0, Diffuse));
SearchRadius = Math.Max(0.0001, SearchRadius);

double sensorRad = Rhino.RhinoMath.ToRadians(SensorAngle);
double turnRad = Rhino.RhinoMath.ToRadians(TurnAngle);

// ------------------------------------------------------------
// Diffuse + decay on mesh topology
// ------------------------------------------------------------
int vertexCount = state.FieldVals.Length;
double[] field = state.FieldVals;
double[] nextField = state.NextFieldVals;

Parallel.For(0, vertexCount, mv =>
{
	int topo = state.MeshVertexToTopo[mv];
	int[] nbrTopo = state.TopoNeighbors[topo];

	double center = field[mv];
	double sum = center;
	int count = 1;

	for (int i = 0; i < nbrTopo.Length; i++)
	{
		int topoNbr = nbrTopo[i];
		int[] meshVerts = state.Mesh.TopologyVertices.MeshVertexIndices(topoNbr);
		if (meshVerts == null || meshVerts.Length == 0) continue;

		for (int j = 0; j < meshVerts.Length; j++)
		{
			int mvi = meshVerts[j];
			sum += field[mvi];
			count++;
		}
	}

	double avg = sum / count;
	double v = center * (1.0 - Diffuse) + avg * Diffuse;
	v *= (1.0 - Decay);

	if (v < 0.0) v = 0.0;
	if (v > 1.0) v = 1.0;

	nextField[mv] = v;
});

// swap field buffers
state.FieldVals = nextField;
state.NextFieldVals = field;
field = state.FieldVals;

// ------------------------------------------------------------
// Move agents
// ------------------------------------------------------------
Random rndStep = new Random(Guid.NewGuid().GetHashCode());

for (int a = 0; a < state.AgentPts.Count; a++)
{
	Point3d p = state.AgentPts[a];
	Vector3d dir = state.AgentDirs[a];
	int currentVertex = state.AgentVertexIds[a];

	if (currentVertex < 0 || currentVertex >= state.Mesh.Vertices.Count)
		currentVertex = ClosestMeshVertexLinear(state.Mesh, p);

	Vector3d n = MeshVertexNormalSafe(state.Mesh, currentVertex);

	dir = ProjectToPlane(dir, n);
	if (dir.Length < Rhino.RhinoMath.ZeroTolerance)
		dir = AnyPerpendicular(n);
	dir.Unitize();

	Vector3d left = Rotate(dir, n, sensorRad);
	Vector3d right = Rotate(dir, n, -sensorRad);

	left = ProjectToPlane(left, n);
	right = ProjectToPlane(right, n);

	if (left.Length < Rhino.RhinoMath.ZeroTolerance) left = AnyPerpendicular(n);
	if (right.Length < Rhino.RhinoMath.ZeroTolerance) right = AnyPerpendicular(n);

	left.Unitize();
	right.Unitize();

	double f = SampleMeshField(state, p + dir * SensorDistance, SearchRadius);
	double l = SampleMeshField(state, p + left * SensorDistance, SearchRadius);
	double r = SampleMeshField(state, p + right * SensorDistance, SearchRadius);

	if (f > l && f > r)
	{
	}
	else if (f < l && f < r)
	{
		if (rndStep.NextDouble() < 0.5)
			dir = Rotate(dir, n, turnRad);
		else
			dir = Rotate(dir, n, -turnRad);
	}
	else if (l > r)
	{
		dir = Rotate(dir, n, turnRad);
	}
	else if (r > l)
	{
		dir = Rotate(dir, n, -turnRad);
	}

	dir = ProjectToPlane(dir, n);
	if (dir.Length < Rhino.RhinoMath.ZeroTolerance)
		dir = AnyPerpendicular(n);
	dir.Unitize();

	Point3d guess = p + dir * StepSize;

	MeshPoint mpNext = state.Mesh.ClosestMeshPoint(guess, 0.0);
	Point3d next = p;
	int nextVertex = currentVertex;

	if (mpNext != null)
	{
		next = mpNext.Point;
		nextVertex = ClosestMeshVertexFromMeshPoint(state.Mesh, mpNext);
		if (nextVertex < 0) nextVertex = ClosestMeshVertexLinear(state.Mesh, next);
	}

	// deposit to nearest mesh vertex
	if (nextVertex >= 0 && nextVertex < state.FieldVals.Length)
	{
		double nv = state.FieldVals[nextVertex] + Deposit;
		if (nv > 1.0) nv = 1.0;
		state.FieldVals[nextVertex] = nv;
	}

	state.AgentPts[a] = next;
	state.AgentDirs[a] = dir;
	state.AgentVertexIds[a] = nextVertex;

	// always record trail
	var path = new GH_Path(a);
	state.TrailTree.Append(new GH_Point(next), path);
}

// ============================================================
// OUTPUTS
// ============================================================
AgentsOut = state.AgentPts;
FieldPts = state.FieldPts;

List<double> outVals = new List<double>(state.FieldVals.Length);
for (int i = 0; i < state.FieldVals.Length; i++)
	outVals.Add(state.FieldVals[i]);
FieldVals = outVals;

Trail = state.TrailTree;

// ============================================================
// HELPERS
// ============================================================
double SampleMeshField(SimState s, Point3d p, double radius)
{
	MeshPoint mp = s.Mesh.ClosestMeshPoint(p, 0.0);
	if (mp == null) return 0.0;

	Point3d q = mp.Point;
	int centerVertex = ClosestMeshVertexFromMeshPoint(s.Mesh, mp);
	if (centerVertex < 0) centerVertex = ClosestMeshVertexLinear(s.Mesh, q);
	if (centerVertex < 0) return 0.0;

	int topo = s.MeshVertexToTopo[centerVertex];
	int[] nbrTopo = s.TopoNeighbors[topo];

	double sum = 0.0;
	double wsum = 0.0;

	// center
	Point3d cp = s.Mesh.Vertices.Point3dAt(centerVertex);
	double dc = cp.DistanceTo(q);
	double wc = 1.0 / (0.0001 + dc);
	sum += s.FieldVals[centerVertex] * wc;
	wsum += wc;

	// 1-ring neighborhood
	for (int i = 0; i < nbrTopo.Length; i++)
	{
		int[] meshVerts = s.Mesh.TopologyVertices.MeshVertexIndices(nbrTopo[i]);
		if (meshVerts == null) continue;

		for (int j = 0; j < meshVerts.Length; j++)
		{
			int mv = meshVerts[j];
			Point3d vp = s.Mesh.Vertices.Point3dAt(mv);
			double d = vp.DistanceTo(q);
			if (d <= radius)
			{
				double w = 1.0 / (0.0001 + d);
				sum += s.FieldVals[mv] * w;
				wsum += w;
			}
		}
	}

	if (wsum <= Rhino.RhinoMath.ZeroTolerance) return 0.0;
	return sum / wsum;
}

int ClosestMeshVertexFromMeshPoint(Mesh mesh, MeshPoint mp)
{
	if (mesh == null || mp == null) return -1;
	int fi = mp.FaceIndex;
	if (fi < 0 || fi >= mesh.Faces.Count) return -1;

	MeshFace f = mesh.Faces[fi];
	Point3d p = mp.Point;

	int[] ids;
	if (f.IsTriangle)
		ids = new int[] { f.A, f.B, f.C };
	else
		ids = new int[] { f.A, f.B, f.C, f.D };

	double best = double.MaxValue;
	int bestId = -1;

	for (int i = 0; i < ids.Length; i++)
	{
		Point3d v = mesh.Vertices.Point3dAt(ids[i]);
		double d = v.DistanceToSquared(p);
		if (d < best)
		{
			best = d;
			bestId = ids[i];
		}
	}
	return bestId;
}

int ClosestMeshVertexLinear(Mesh mesh, Point3d p)
{
	if (mesh == null || mesh.Vertices.Count == 0) return -1;

	double best = double.MaxValue;
	int bestId = -1;

	for (int i = 0; i < mesh.Vertices.Count; i++)
	{
		Point3d v = mesh.Vertices.Point3dAt(i);
		double d = v.DistanceToSquared(p);
		if (d < best)
		{
			best = d;
			bestId = i;
		}
	}
	return bestId;
}

Vector3d MeshVertexNormalSafe(Mesh mesh, int vertexId)
{
	if (mesh != null && vertexId >= 0 && vertexId < mesh.Normals.Count)
	{
		Vector3d n = mesh.Normals[vertexId];
		if (n.IsValid && n.Length > Rhino.RhinoMath.ZeroTolerance)
		{
			n.Unitize();
			return n;
		}
	}
	return Vector3d.ZAxis;
}

Vector3d Rotate(Vector3d v, Vector3d axis, double angle)
{
	Transform t = Transform.Rotation(angle, axis, Point3d.Origin);
	v.Transform(t);
	return v;
}

Vector3d RandomUnit(Random r)
{
	Vector3d v = new Vector3d(
		r.NextDouble() * 2.0 - 1.0,
		r.NextDouble() * 2.0 - 1.0,
		r.NextDouble() * 2.0 - 1.0
	);

	if (v.Length < Rhino.RhinoMath.ZeroTolerance)
		v = Vector3d.XAxis;

	v.Unitize();
	return v;
}

Vector3d ProjectToPlane(Vector3d v, Vector3d normal)
{
	Vector3d n = normal;
	n.Unitize();
	return v - (v * n) * n;
}

Vector3d AnyPerpendicular(Vector3d n)
{
	n.Unitize();
	Vector3d test = Math.Abs(n * Vector3d.XAxis) < 0.9 ? Vector3d.XAxis : Vector3d.YAxis;
	Vector3d p = Vector3d.CrossProduct(n, test);
	if (p.Length < Rhino.RhinoMath.ZeroTolerance)
		p = Vector3d.CrossProduct(n, Vector3d.ZAxis);
	if (p.Length < Rhino.RhinoMath.ZeroTolerance)
		p = Vector3d.XAxis;
	p.Unitize();
	return p;
}

// ============================================================
// STATE
// ============================================================
class SimState
{
	public Mesh Mesh;
	public List<Point3d> FieldPts;
	public double[] FieldVals;
	public double[] NextFieldVals;
	public List<Point3d> AgentPts;
	public List<Vector3d> AgentDirs;
	public List<int> AgentVertexIds;
	public int[][] TopoNeighbors;
	public int[] MeshVertexToTopo;
	public GH_Structure<GH_Point> TrailTree;
}

static class SolverState
{
	public static Dictionary<string, SimState> Store;
}
# ---------- end c_script_5 ----------
gradient = Gradient(
    LowerLimit=1,
    UpperLimit=0,
    Parameter=c_script_5.FieldVals,
    stops=[0: RGB(234, 38, 0), 0.25: RGB(234, 126, 0), 0.5: RGB(254, 244, 84), 0.75: RGBA(173, 203, 249, 200), 1: RGBA(75, 107, 169, 50)])
list_length = ListLength(List=c_script_5.FieldPts)
panel_5 = Panel(list_length)
cloud_display = CloudDisplay(Points=c_script_5.FieldPts, Colours=gradient, Size=1, SpriteType=0)
point = Point(c_script_5.Trail)
list_length_2 = ListLength(List=point)
multiplication = Multiplication(A=list_length_2, B=Slider(0.25, range=0..1))
split_list = SplitList(List=point, Index=multiplication)  # -> ListA, ListB
polyline = PolyLine(Vertices=split_list.ListB, Closed=False)
clean_tree = CleanTree(RemoveNulls=True, RemoveInvalid=True, RemoveEmpty=True, Tree=polyline)
length = Length(Curve=clean_tree)
smaller_than = SmallerThan(FirstNumber=length, SecondNumber=Slider(5, range=0..20))  # -> SmallerThan, OrEqualTo
cull_pattern = CullPattern(List=clean_tree, CullPattern=invert(smaller_than.SmallerThan))  # -> flatten(List)
curve_2 = Curve(cull_pattern)
data_dam = DataDam(DataA=cull_pattern, BufferDelay=10000000, BufferMode=0)
list_length_3 = ListLength(List=data_dam)
multiplication_2 = Multiplication(A=list_length_3, B=0.6)
random_reduce = RandomReduce(List=data_dam, Reduction=multiplication_2, Seed=1)
explode = Explode(Curve=random_reduce, Recursive=True)  # -> flatten(Segments), Vertices
removeduplicatelines = RemoveDuplicateLines(Lines=explode.Segments, Tolerance=0.7)
curveconnection = CSharpScript(Curve=removeduplicatelines, Radius=0.6)  # -> ConnectedCurve; inputs Curve: list of Curve, Radius: Double
# ---------- curveconnection: C# ----------
using System;
using System.Collections.Generic;
using System.Linq;
using System.Threading.Tasks;
using Rhino.Geometry;

public class Script_Instance : GH_ScriptInstance
{
  private void RunScript(
		List<Curve> Curve,
		double Radius,
		ref object ConnectedCurve)
  {
    List<Curve> result = new List<Curve>();

    if (Curve == null || Curve.Count == 0)
    {
      ConnectedCurve = result;
      return;
    }

    Radius = Math.Max(0.0, Radius);
    double r2 = Radius * Radius;

    List<Curve> validCurves = Curve.Where(c => c != null).ToList();
    if (validCurves.Count == 0)
    {
      ConnectedCurve = result;
      return;
    }

    // --------------------------------------------------------
    // 1. Collect endpoints
    // --------------------------------------------------------
    List<Point3d> pts = new List<Point3d>();
    List<int> parentIds = new List<int>();

    for (int i = 0; i < validCurves.Count; i++)
    {
      Curve c = validCurves[i];
      pts.Add(c.PointAtStart);
      parentIds.Add(i);

      pts.Add(c.PointAtEnd);
      parentIds.Add(i);
    }

    if (pts.Count == 0)
    {
      ConnectedCurve = validCurves;
      return;
    }

    // --------------------------------------------------------
    // 2. Build RTree
    // --------------------------------------------------------
    RTree tree = new RTree();
    for (int i = 0; i < pts.Count; i++)
      tree.Insert(pts[i], i);

    // --------------------------------------------------------
    // 3. Parallel nearest valid endpoint search
    // --------------------------------------------------------
    int[] bestMatch = new int[pts.Count];
    for (int i = 0; i < bestMatch.Length; i++) bestMatch[i] = -1;

    Parallel.For(0, pts.Count, i =>
    {
      Point3d p = pts[i];
      List<int> candidates = new List<int>();

      tree.Search(new Sphere(p, Radius), (sender, e) =>
      {
        candidates.Add(e.Id);
      });

      int bestJ = -1;
      double bestD2 = double.MaxValue;

      for (int k = 0; k < candidates.Count; k++)
      {
        int j = candidates[k];

        if (j == i) continue;
        if (parentIds[j] == parentIds[i]) continue;

        double d2 = p.DistanceToSquared(pts[j]);
        if (d2 <= r2 && d2 < bestD2)
        {
          bestD2 = d2;
          bestJ = j;
        }
      }

      bestMatch[i] = bestJ;
    });

    // --------------------------------------------------------
    // 4. Build unique connection lines
    // --------------------------------------------------------
    HashSet<string> seen = new HashSet<string>();
    List<Curve> connectors = new List<Curve>();

    for (int i = 0; i < pts.Count; i++)
    {
      int j = bestMatch[i];
      if (j < 0) continue;

      int a = Math.Min(i, j);
      int b = Math.Max(i, j);
      string key = a.ToString() + "_" + b.ToString();

      if (seen.Contains(key)) continue;
      seen.Add(key);

      connectors.Add(new LineCurve(pts[i], pts[j]));
    }

    // --------------------------------------------------------
    // 5. Join original curves + connectors
    // --------------------------------------------------------
    List<Curve> allCurves = new List<Curve>();
    allCurves.AddRange(validCurves);
    allCurves.AddRange(connectors);

    double joinTol = 0.01;
    Curve[] joined = Rhino.Geometry.Curve.JoinCurves(allCurves.ToArray(), joinTol);

    if (joined != null && joined.Length > 0)
      result = joined.ToList();
    else
      result = allCurves;

    ConnectedCurve = result;
  }
}
# ---------- end curveconnection ----------
smooth_curve_network = CSharpScript(Curve=curveconnection, Subdivision=4, Iteration=5)  # -> Smoothed; inputs Curve: list of Curve, Subdivision: Int32, Iteration: Int32
# ---------- smooth_curve_network: C# ----------
using System;
using System.Collections.Generic;
using System.Linq;
using System.Threading.Tasks;
using Rhino;
using Rhino.Geometry;
using Rhino.Geometry.Intersect;

public class Script_Instance : GH_ScriptInstance
{
  private void RunScript(
		List<Curve> Curve,
		int Subdivision,
		int Iteration,
		ref object Smoothed)
  {
    List<Curve> outCurves = new List<Curve>();

    if (Curve == null || Curve.Count == 0)
    {
      Smoothed = outCurves;
      return;
    }

    double tol = 0.01;
    int subdivFactor = Math.Max(1, Subdivision);
    int iters = Math.Max(0, Iteration);
    double nodeBlend = 0.2;

    List<Curve> validCurves = Curve.Where(c => c != null).ToList();
    int crvCount = validCurves.Count;

    if (crvCount == 0)
    {
      Smoothed = outCurves;
      return;
    }

    // -------------------- split params + endpoints --------------------
    List<List<double>> splitParams = new List<List<double>>(crvCount);
    List<Point3d> rawNodes = new List<Point3d>();

    for (int i = 0; i < crvCount; i++)
    {
      Curve c = validCurves[i];
      splitParams.Add(new List<double> { c.Domain.T0, c.Domain.T1 });
      rawNodes.Add(c.PointAtStart);
      rawNodes.Add(c.PointAtEnd);
    }

    BoundingBox[] bboxes = new BoundingBox[crvCount];
    for (int i = 0; i < crvCount; i++)
    {
      BoundingBox bb = validCurves[i].GetBoundingBox(true);
      bb.Inflate(tol);
      bboxes[i] = bb;
    }

    object rawNodeLock = new object();
    object[] splitLocks = new object[crvCount];
    for (int i = 0; i < crvCount; i++) splitLocks[i] = new object();

    Parallel.For(0, crvCount, i =>
    {
      Curve a = validCurves[i];
      BoundingBox bbA = bboxes[i];

      List<Point3d> localNodes = new List<Point3d>();
      Dictionary<int, List<double>> localParams = new Dictionary<int, List<double>>();
      localParams[i] = new List<double>();

      for (int j = i + 1; j < crvCount; j++)
      {
        if (!BBoxesOverlap(bbA, bboxes[j])) continue;

        Curve b = validCurves[j];
        var events = Intersection.CurveCurve(a, b, tol, tol);
        if (events == null || events.Count == 0) continue;

        if (!localParams.ContainsKey(j)) localParams[j] = new List<double>();

        foreach (var ev in events)
        {
          if (ev.IsPoint)
          {
            localNodes.Add(ev.PointA);
            localParams[i].Add(ev.ParameterA);
            localParams[j].Add(ev.ParameterB);
          }
        }
      }

      if (localNodes.Count > 0)
      {
        lock (rawNodeLock) rawNodes.AddRange(localNodes);
      }

      foreach (var kv in localParams)
      {
        if (kv.Value.Count == 0) continue;
        lock (splitLocks[kv.Key]) splitParams[kv.Key].AddRange(kv.Value);
      }
    });

    for (int i = 0; i < crvCount; i++)
      splitParams[i] = UniqueSorted(splitParams[i]);

    // -------------------- cluster nodes --------------------
    Dictionary<string, List<Point3d>> buckets = new Dictionary<string, List<Point3d>>();
    foreach (Point3d p in rawNodes)
    {
      string key = PointKey(p, tol);
      if (!buckets.ContainsKey(key))
        buckets[key] = new List<Point3d>();
      buckets[key].Add(p);
    }

    List<Point3d> nodePositions = new List<Point3d>();
    Dictionary<string, int> nodeLookup = new Dictionary<string, int>();

    foreach (var kv in buckets)
    {
      Point3d p = AvgPoint(kv.Value);
      int idx = nodePositions.Count;
      nodePositions.Add(p);

      foreach (Point3d q in kv.Value)
        nodeLookup[PointKey(q, tol)] = idx;
    }

    // -------------------- edges --------------------
    List<int> edgeN0 = new List<int>();
    List<int> edgeN1 = new List<int>();
    List<List<Point3d>> edgePts = new List<List<Point3d>>();
    Dictionary<int, List<int>> nodeEdges = new Dictionary<int, List<int>>();

    for (int ci = 0; ci < crvCount; ci++)
    {
      Curve c = validCurves[ci];
      var pars = splitParams[ci];

      for (int k = 0; k < pars.Count - 1; k++)
      {
        Curve seg = c.Trim(pars[k], pars[k + 1]);
        if (seg == null || seg.GetLength() <= tol) continue;

        string k0 = PointKey(seg.PointAtStart, tol);
        string k1 = PointKey(seg.PointAtEnd, tol);

        if (!nodeLookup.ContainsKey(k0) || !nodeLookup.ContainsKey(k1)) continue;

        int n0 = nodeLookup[k0];
        int n1 = nodeLookup[k1];

        List<Point3d> pts = ResampleSpanBySegmentFactor(seg, subdivFactor);

        int ei = edgePts.Count;
        edgeN0.Add(n0);
        edgeN1.Add(n1);
        edgePts.Add(pts);

        if (!nodeEdges.ContainsKey(n0)) nodeEdges[n0] = new List<int>();
        if (!nodeEdges.ContainsKey(n1)) nodeEdges[n1] = new List<int>();
        nodeEdges[n0].Add(ei);
        nodeEdges[n1].Add(ei);
      }
    }

    // -------------------- smoothing --------------------
    for (int iter = 0; iter < iters; iter++)
    {
      Point3d[] nodeArray = nodePositions.ToArray();

      Parallel.For(0, edgePts.Count, ei =>
      {
        var pts = edgePts[ei];
        pts[0] = nodeArray[edgeN0[ei]];
        pts[pts.Count - 1] = nodeArray[edgeN1[ei]];
        edgePts[ei] = SmoothInteriorPoints(pts);
      });
    }

    // -------------------- build + join --------------------
// build segments
List<Curve> segments = new List<Curve>();

for (int i = 0; i < edgePts.Count; i++)
{
  if (edgePts[i] != null && edgePts[i].Count >= 2)
    segments.Add(new PolylineCurve(edgePts[i]));
}

// IMPORTANT: convert explicitly to array
Curve[] segArray = segments.ToArray();

// STATIC CALL on Curve (NOT List)
Curve[] joined = Rhino.Geometry.Curve.JoinCurves(segArray, tol);

// assign output
if (joined != null && joined.Length > 0)
  Smoothed = joined;
else
  Smoothed = segArray;

  // -------------------- helpers --------------------

  string PointKey(Point3d pt, double tol)
  {
    return ((int)(pt.X / tol)) + "_" + ((int)(pt.Y / tol)) + "_" + ((int)(pt.Z / tol));
  }

  Point3d AvgPoint(List<Point3d> pts)
  {
    double x = 0, y = 0, z = 0;
    foreach (var p in pts) { x += p.X; y += p.Y; z += p.Z; }
    return new Point3d(x / pts.Count, y / pts.Count, z / pts.Count);
  }

  List<double> UniqueSorted(List<double> vals)
  {
    vals.Sort();
    return vals.Distinct().ToList();
  }

  List<Point3d> SmoothInteriorPoints(List<Point3d> pts)
  {
    var outPts = new List<Point3d>(pts);
    for (int i = 1; i < pts.Count - 1; i++)
      outPts[i] = new Point3d(
        (pts[i - 1].X + 2 * pts[i].X + pts[i + 1].X) / 4,
        (pts[i - 1].Y + 2 * pts[i].Y + pts[i + 1].Y) / 4,
        (pts[i - 1].Z + 2 * pts[i].Z + pts[i + 1].Z) / 4);
    return outPts;
  }

  List<Point3d> ResampleSpanBySegmentFactor(Curve curve, int factor)
  {
    Polyline pl;
    if (curve.TryGetPolyline(out pl))
    {
      List<Point3d> pts = new List<Point3d>();
      for (int i = 0; i < pl.Count - 1; i++)
      {
        for (int k = 0; k < factor; k++)
        {
          double t = (double)k / factor;
          pts.Add(pl[i] + (pl[i + 1] - pl[i]) * t);
        }
      }
      pts.Add(pl[pl.Count - 1]);
      return pts;
    }
    return new List<Point3d> { curve.PointAtStart, curve.PointAtEnd };
  }

  bool BBoxesOverlap(BoundingBox a, BoundingBox b)
  {
    return !(a.Max.X < b.Min.X || a.Min.X > b.Max.X ||
             a.Max.Y < b.Min.Y || a.Min.Y > b.Max.Y ||
             a.Max.Z < b.Min.Z || a.Min.Z > b.Max.Z);
  }
  }
  }
# ---------- end smooth_curve_network ----------
length_2 = Length(Curve=smooth_curve_network)
smaller_than_2 = SmallerThan(FirstNumber=length_2, SecondNumber=Slider(1, range=0..10))  # -> SmallerThan, OrEqualTo
cull_pattern_2 = CullPattern(List=smooth_curve_network, CullPattern=invert(smaller_than_2.SmallerThan))  # -> graft(List)
curve_3 = Curve(cull_pattern_2)
number_slider = Slider(40, range=0..50)
range = Range(Domain=Domain(0, -5), Steps=expr("x-1", number_slider))
series = Series(Start=0, Step=0.5, Count=number_slider)
unit_z = UnitZ(Factor=series)
move = Move(Geometry=cull_pattern_2, Motion=unit_z)  # -> simplify(Geometry), Transform
graph_mapper = GraphMapper(range, x0=0, x1=-5, y0=0, y1=-5, container_name="Bezier", cpx=[0, 1, 0.3768115938, 1], cpy=[0, 0, 1, 1])
tree_statistics = TreeStatistics(Tree=move.Geometry)  # -> Paths, Length, Count
repeat_data = RepeatData(Data=graph_mapper, Length=tree_statistics.Length)  # -> simplify(Data)
extend_curve = ExtendCurve(Curve=move.Geometry, Type=0, Start=repeat_data, End=repeat_data)
length_3 = Length(Curve=extend_curve)
smaller_than_3 = SmallerThan(FirstNumber=length_3, SecondNumber=Slider(1.5, range=0..10))  # -> SmallerThan, OrEqualTo
cull_pattern_3 = CullPattern(List=extend_curve, CullPattern=invert(smaller_than_3.SmallerThan))  # -> graft(List)
create_settings = CreateSettings(VoxelSize=0.3, Bandwidth=1, Isovalue=0, Adaptivity=0)  # disabled
clean_tree_2 = CleanTree(RemoveNulls=True, RemoveInvalid=True, RemoveEmpty=True, Tree=cull_pattern_3)  # -> flatten(Tree); disabled
curve_to_volume = CurveToVolume(Curves=clean_tree_2, CurveRadius=1.25, Settings=create_settings)  # disabled
volume_to_mesh = VolumeToMesh(Volume=curve_to_volume, VolumeSettings=create_settings)  # disabled
custom_preview = CustomPreview(
    Geometry=volume_to_mesh,
    Material={diffuse=RGB(221, 160, 221), emission=RGB(66, 48, 66), shine=0.5, specular=RGB(255, 255, 255), transparency=0})  # disabled

# ---- group: Starting Curves (Closed)
geometry_pipeline_2 = GeometryPipeline(
    GroupByLayer=False,
    GroupByType=False,
    IncludeHidden=True,
    IncludeLocked=True,
    LayerFilter="Start",
    NameFilter="*",
    SublayerFiltering=True,
    TypeFilter=4)
curve_4 = Curve(geometry_pipeline_2)
closed_2 = Closed(Curve=curve_4)  # -> Closed, Periodic
panel_6 = Panel(closed_2.Closed)

# ----
c_script_6 = CSharpScript(Curve=curve_4, Mesh=mesh)  # -> PulledCurve; inputs Curve: list of Curve, Mesh: Mesh; same code as c_script_2

# ---- group: Starting Curves (Closed) (continued)
curve_5 = Curve(c_script_6)

# ----
curve_6 = Curve(curve_5)  # disabled
divide_curve = DivideCurve(Curve=curve_6, Count=700, Kinks=False)  # -> Points, Tangents, Parameters; disabled
polyline_2 = PolyLine(Vertices=divide_curve.Points, Closed=True)  # disabled
explode_2 = Explode(Curve=polyline_2, Recursive=True)  # -> Segments, Vertices; disabled

# ---- group: Growth Step Incrementation Loop
reader = Python3Script()  # -> status, data; disabled
# ---------- reader: Python ----------
# Outputs:
#   data
#   status

import os

buffer_path = os.path.join(os.getenv('TEMP'), "gh_buffer.txt")

if os.path.exists(buffer_path):
    try:
        with open(buffer_path, "r") as f:
            data = f.read()
        status = "Data read successfully"
    except Exception as e:
        data = None
        status = "Read error: {}".format(e)
else:
    data = None
    status = "Buffer file not found"
# ---------- end reader ----------

# ----
remap_numbers = RemapNumbers(Value=reader.data, Source=Domain(0, 100), Target=Domain(0, 6))  # -> Mapped, Clipped; disabled

# ---- group: Kangaroo Setup
length_line = LengthLine(Line=explode_2.Segments, Strength=2)  # disabled
onmesh = OnMesh(Points=divide_curve.Points, Mesh=mesh_3, Strength=50)  # disabled
spherecollide = SphereCollide(Points=flatten(divide_curve.Points), Radius=remap_numbers.Mapped, Strength=1)  # disabled
merge = Merge(Data1=spherecollide, Data2=onmesh, Data3=length_line)  # disabled
bouncysolver = BouncySolver(GoalObjects=merge, Reset=reset, Threshold=0.0001, Tolerance=0.001, Damping=0.95, Iterations=10, On=True)  # -> I, V, O; disabled

# ----
isconverged = CSharpScript(x=bouncysolver.I)  # -> out, A; disabled
# ---------- isconverged: C# ----------
using System;
using System.Collections;
using System.Collections.Generic;

using Rhino;
using Rhino.Geometry;

using Grasshopper;
using Grasshopper.Kernel;
using Grasshopper.Kernel.Data;
using Grasshopper.Kernel.Types;

/// <summary>
/// This class will be instantiated on demand by the Script component.
/// </summary>
public class Script_Instance : GH_ScriptInstance
{
  /// <summary>Print a String to the [Out] Parameter of the Script component.</summary>
  /// <param name="text">String to print.</param>
  private void Print(string text) { /* Implementation hidden. */ }
  /// <summary>Print a formatted String to the [Out] Parameter of the Script component.</summary>
  /// <param name="format">String format.</param>
  /// <param name="args">Formatting parameters.</param>
  private void Print(string format, params object[] args) { /* Implementation hidden. */ }
  /// <summary>Print useful information about an object instance to the [Out] Parameter of the Script component. </summary>
  /// <param name="obj">Object instance to parse.</param>
  private void Reflect(object obj) { /* Implementation hidden. */ }
  /// <summary>Print the signatures of all the overloads of a specific method to the [Out] Parameter of the Script component. </summary>
  /// <param name="obj">Object instance to parse.</param>
  private void Reflect(object obj, string method_name) { /* Implementation hidden. */ }

  /// <summary>Gets the current Rhino document.</summary>
  private readonly RhinoDoc RhinoDocument;
  /// <summary>Gets the Grasshopper document that owns this script.</summary>
  private readonly GH_Document GrasshopperDocument;
  /// <summary>Gets the Grasshopper script component that owns this script.</summary>
  private readonly IGH_Component Component;
  /// <summary>
  /// Gets the current iteration count. The first call to RunScript() is associated with Iteration==0.
  /// Any subsequent call within the same solution will increment the Iteration count.
  /// </summary>
  private readonly int Iteration;

  /// <summary>
  /// This procedure contains the user code. Input parameters are provided as regular arguments,
  /// Output parameters as ref arguments. You don't have to assign output parameters,
  /// they will have a default value.
  /// </summary>
  private void RunScript(object x, ref object A)
  {

    Grasshopper.Kernel.IGH_Param param = this.Component.Params.Input[0].Sources[0];
    IGH_Component a = param.Attributes.GetTopLevel.DocObject as IGH_Component;
    A = (a.Message == "Converged");

  }

  // <Custom additional code> 

  // </Custom additional code> 
}
# ---------- end isconverged ----------
unflatten_tree = UnflattenTree(Tree=bouncysolver.V, Guide=divide_curve.Points)  # disabled

# ---- group: Recording Iteration Number
integer = Integer(isconverged.A)  # disabled
data_recorder = Python3Script(Data=integer, Reset=reset, Record=True)  # -> DataOut; inputs Data: tree, Reset: Boolean, Record: Boolean; disabled
# ---------- data_recorder: Python ----------
# Inputs:
# Data (No Type Hint)  ← IMPORTANT (keep tree structure)
# Record (Boolean)
# Reset (Boolean)

# Output:
# DataOut (Tree)

import Grasshopper as gh

# Initialize
if "recorded_data" not in globals() or Reset:
    recorded_data = gh.DataTree[object]()

# Record
if Record and Data is not None:
    for path in Data.Paths:
        for item in Data.Branch(path):
            recorded_data.Add(item, path)

# Output
DataOut = recorded_data
# ---------- end data_recorder ----------
mass_addition = MassAddition(Input=data_recorder)  # -> Result, PartialResults; disabled
x_minus_one = XMinusOne(NumberX=mass_addition.Result)  # disabled

# ----
clean_tree_3 = CleanTree(RemoveNulls=True, RemoveInvalid=True, RemoveEmpty=True, Tree=unflatten_tree)  # disabled
polyline_3 = PolyLine(Vertices=clean_tree_3, Closed=True)  # disabled

# ---- group: Recording Curve Iteration
stream_gate = StreamGate(Stream=polyline_3, Gate=isconverged.A)  # -> Target0, Target1; disabled
data_recorder_2 = Python3Script(Data=stream_gate.Target1, Reset=reset, Record=True)  # -> DataOut; inputs Data: tree, Reset: Boolean, Record: Boolean; disabled; same code as data_recorder
rebuild_curve = RebuildCurve(Curve=data_recorder_2, Degree=3, Count=500, Tangents=False)  # disabled

# ---- group: Growth Step Incrementation Loop (continued)
writer = Python3Script(data=x_minus_one)  # -> status; disabled
# ---------- writer: Python ----------
# Inputs:
#   data: string or number to store
# Outputs:
#   status: feedback message for panel

import os

if data is not None:
    buffer_path = os.path.join(os.getenv('TEMP'), "gh_buffer.txt")
    try:
        with open(buffer_path, "w") as f:
            f.write(str(data))
        status = "Data written to: {}".format(buffer_path)
    except Exception as e:
        status = "Write error: {}".format(e)
else:
    status = "No input data received"
# ---------- end writer ----------

# ---- group: Preview Toolpath Geometry
boolean_toggle = BooleanToggle(False)  # disabled
stream_gate_2 = StreamGate(Stream=rebuild_curve, Gate=boolean_toggle)  # -> Target0, Target1; disabled

# ---- group: Toolpath & Geometry based on reduced growth steps
layer_thickness_mm = Slider(2, range=0..5)  # disabled
total_height_mm = Slider(50, range=10..100)  # disabled
curve_7 = Curve(stream_gate_2.Target1)  # disabled
list_length_4 = ListLength(List=curve_7)  # disabled
panel_7 = Panel("""0.6
0.7
0.8
0.9
1""")  # disabled
multiplication_3 = Multiplication(A=list_length_4, B=panel_7)  # disabled
division = Division(A=total_height_mm, B=layer_thickness_mm)  # disabled
list_item = ListItem(List=curve_7, Index=expr("x-1", multiplication_3), Wrap=True)  # -> simplify(Item); disabled
range_2 = Range(Domain=Domain(0, 1), Steps=division)  # disabled
multiplication_4 = Multiplication(A=range_2, B=total_height_mm)  # disabled
tween_through_curves = TweenThroughCurves(
    Curves=list_item,
    Factor=range_2,
    Normalized=True,
    Equalized=False,
    Loopback=False,
    InterpolationType=1,
    Refit=0,
    PointSample=0)  # disabled
unit_z_2 = UnitZ(Factor=multiplication_4)  # disabled
move_2 = Move(Geometry=tween_through_curves, Motion=unit_z_2)  # -> Geometry, Transform; disabled
loft = Loft(Curves=move_2.Geometry, Options={Adjust=False, Closed=False, LoftEnds=0, LoftSimp=0, LoftType=0, Rebuild=10, Refit=0.01})  # disabled
custom_preview_2 = CustomPreview(
    Geometry=loft,
    Material={diffuse=RGB(221, 160, 221), emission=RGB(66, 48, 66), shine=0.5, specular=RGB(255, 255, 255), transparency=0})  # disabled
